# Grasshopper definition e9bb0eac0448fdda61f1d2f23e072e67f1760d99.gh (Grasshopper 1.0.4)

crv = Curve(simplify(Tree({0;0;0;0;0}: [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], {0;1;0;0;0}: [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], {0;2;0;0;0}: [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], {0;3;0;0;0}: [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], {0;4;0;0;0}: [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], {0;5;0;0;0}: [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]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)))
tree_branch = TreeBranch(Tree=crv, Path=Slider(8, range=0..39), MaintainPaths=True)
explode = Explode(Curve=tree_branch, Recursive=True)  # -> Segments, Vertices
flip_matrix = FlipMatrix(Data=explode.Segments)
loft = Loft(Curves=flip_matrix, Options={Adjust=False, Closed=True, LoftEnds=0, LoftSimp=0, LoftType=0, Rebuild=25, Refit=0.001})
brep_join = BrepJoin(Breps=flatten(loft))  # -> Breps, Closed
null = NullItem(Item=loft)  # -> NullFlags, InvalidFlags, Description
cap = CapHoles(Brep=brep_join.Breps)  # -> simplify(Brep)
panel = Panel(cap)
panel_2 = Panel(null.Description)
