# Grasshopper definition 0092ed9ab0864c97f842842eaf17b937a5ee843f.ghx (Grasshopper 1.0.7)

pt = ConstructPoint(XCoordinate=0, YCoordinate=0, ZCoordinate=100)
pt_2 = ConstructPoint(XCoordinate=0, YCoordinate=0, ZCoordinate=0)
ln = Line(StartPoint=pt_2, EndPoint=pt)
move = Move(Geometry=ln, Motion=Vector(-25, 25, 0))  # -> Geometry, Transform
divide = DivideCurve(Curve=move.Geometry, Count=10, Kinks=False)  # -> Points, Tangents, Parameters
pdecon = Deconstruct(Point=divide.Points)  # -> XComponent, YComponent, ZComponent
addition = Addition(A=pdecon.XComponent, B=100)
pt_3 = ConstructPoint(XCoordinate=addition, YCoordinate=pdecon.YComponent, ZCoordinate=pdecon.ZComponent)
cir = Circle(Plane=PlaneXY(0, 0, 0), Radius=10)
ln_2 = Line(StartPoint=divide.Points, EndPoint=pt_3)
lng = ListLength(List=pt_3)
move_2 = Move(Geometry=cir, Motion=Vector(-25, 25, 0))  # -> Geometry, Transform
series = Series(Start=0, Step=40, Count=lng)
Z = UnitZ(Factor=100)
rad = Radians(Degrees=series)
extr = Extrude(Base=move_2.Geometry, Direction=Z)
rot3d = Rotate3D(Geometry=ln_2, Angle=rad, Center=divide.Points, Axis=Vector(0, 0, 1))  # -> Geometry, Transform
slx = SurfaceLine(Surface=extr, Line=rot3d.Geometry, LimitToFirst=True)  # -> Curves, Points, UVPoints, Normal

xy = XYPlane(Origin=divide.Points)
plcoord = PlaneCoordinates(Point=slx.Points, System=xy)  # -> XCoordinate, YCoordinate, ZCoordinate
expression = Expression(x=plcoord.XCoordinate, y=plcoord.YCoordinate, Expression="Atan2(y,x)")
deg = Degrees(Radians=expression)
degrees = Panel(deg)

pdecon_2 = Deconstruct(Point=slx.Points)  # -> XComponent, YComponent, ZComponent
expression_2 = Expression(x=pdecon_2.XComponent, y=pdecon_2.YComponent, Expression="Atan2(y,x)")
deg_2 = Degrees(Radians=expression_2)
degrees_2 = Panel(deg_2)
