# Grasshopper definition 0e534cb123cef2804707f2b92f6eaad5979ea5db.ghx (Grasshopper 1.0.7)

number_slider = Slider(2.5, range=0..10)
number_slider_2 = Slider(5, range=0..10)
xz = XZPlane(Origin=Point(0, 0, 0))
neg = Negative(Value=Slider(0.86, range=0..3))
rectangle = Rectangle(Plane=xz, XSize=number_slider, YSize=number_slider_2, Radius=0)  # -> Rectangle, Length
explode = Explode(Curve=rectangle.Rectangle, Recursive=True)  # -> Segments, Vertices
panel = Panel("""0
2""")
item = ListItem(List=explode.Segments, Index=0, Wrap=True)  # -> Item, Item1, Item2, Item3
item_2 = ListItem(List=explode.Vertices, Index=0, Wrap=True)  # -> Item, Item1, Item2, Item3
item_3 = ListItem(List=explode.Vertices, Index=panel, Wrap=True)
Y = UnitY(Factor=neg)
curvepoint = PointOnCurve([item.Item, item.Item2], parameter=0.684)
move = Move(Geometry=item_3, Motion=Y)  # -> Geometry, Transform
item_4 = ListItem(List=move.Geometry, Index=0, Wrap=True)  # -> Item, Item1
item_5 = ListItem(List=curvepoint, Index=0, Wrap=True)  # -> Item, Item1
yz = YZPlane(Origin=item_2.Item1)
srf4pt = _4PointSurface(CornerA=item_5.Item, CornerB=item_2.Item1, CornerC=item_4.Item1, CornerD=item_5.Item1)
srf4pt_2 = _4PointSurface(CornerA=item_4.Item, CornerB=item_5.Item, CornerC=item_5.Item1, CornerD=item_2.Item3)
xy = XYPlane(Origin=item_2.Item3)
multiplication = Multiplication(A=number_slider, B=2)
multiplication_2 = Multiplication(A=number_slider_2, B=2)
X = UnitX(Factor=multiplication)
Z = UnitZ(Factor=multiplication_2)
join = BrepJoin(Breps=[srf4pt, srf4pt_2])  # -> Breps, Closed
mirror = Mirror(Geometry=join.Breps, Plane=yz)  # -> Geometry, Transform
join_2 = BrepJoin(Breps=[mirror.Geometry, join.Breps])  # -> Breps, Closed
arrlinear = LinearArray(Geometry=join_2.Breps, Direction=X, Count=Slider(7, range=0..30))  # -> Geometry, Transform
mirror_2 = Mirror(Geometry=arrlinear.Geometry, Plane=xy)  # -> Geometry, Transform
join_3 = BrepJoin(Breps=[arrlinear.Geometry, mirror_2.Geometry])  # -> Breps, Closed
arrlinear_2 = LinearArray(Geometry=join_3.Breps, Direction=Z, Count=Slider(5, range=1..20))  # -> Geometry, Transform
join_4 = BrepJoin(Breps=arrlinear_2.Geometry)  # -> Breps, Closed
wires = BrepWireframe(Brep=join_4.Breps, Density=-1)
panel_2 = Panel(join_4.Breps)
