# Grasshopper definition 12973de3323f32928b73257485c48c366d47cf61.ghx (Grasshopper 1.0.7)

# ---- group: Panel Size
number_slider = Slider(5, range=1..50)
number_slider_2 = Slider(5, range=1..50)

# ---- group: Points Dist from Edge
number_slider_3 = Slider(0.04, range=0..1)
number_slider_4 = Slider(0.96, range=0..1)
number_slider_5 = Slider(0.04, range=0..1)
number_slider_6 = Slider(0.96, range=0..1)

# ---- group: Points Per Panel
number_slider_7 = Slider(10, range=1..50)
number_slider_8 = Slider(12, range=1..50)

# ---- group: Internalized Surface
srf = Surface(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)

# ---- group: Divide Surface into Panels
debrep = DeconstructBrep(Brep=srf)  # -> Faces, Edges, Vertices
len = Length(Curve=debrep.Edges)
item = ListItem(List=len, Index=0, Wrap=True)  # -> Item, Item1
division = Division(A=item.Item, B=number_slider)
division_2 = Division(A=item.Item1, B=number_slider_2)
divide = DivideDomain²(Domain=srf, UCount=division, VCount=division_2)
subsrf = Isotrim(Surface=srf, Domain=divide)

# ----
wires = BrepWireframe(Brep=subsrf, Density=ColourSwatch(SwatchColor=RGB(71, 66, 66)))

# ---- group: Create Planer Panels
debrep_2 = DeconstructBrep(Brep=subsrf)  # -> Faces, Edges, Vertices
item_2 = ListItem(List=debrep_2.Vertices, Index=0, Wrap=True)  # -> Item, Item1, Item2, Item3
srf4pt = _4PointSurface(CornerA=item_2.Item, CornerB=item_2.Item1, CornerC=item_2.Item2, CornerD=item_2.Item3)

# ---- group: "Scale" Surface
dom²num = ConstructDomain²(UMin=number_slider_3, UMax=number_slider_4, VMin=number_slider_5, VMax=number_slider_6)
subsrf_2 = Isotrim(Surface=reparameterize(srf4pt), Domain=dom²num)  # -> simplify(Surface)

# ----
sdivide = DivideSurface(Surface=reparameterize(subsrf_2), UCount=number_slider_7, VCount=number_slider_8)  # -> Points, Normals, Parameters
srf_cp = SurfaceClosestPoint(Point=sdivide.Points, Surface=reparameterize(srf))  # -> Point, UVPoint, Distance
image = ImageSampler(srf_cp.UVPoint, Filter="Value", Interpolate=True, Umax=1, Umin=0, Vmax=1, Vmin=0, Wrap=1)
division_3 = Division(A=image, B=10)
circle = CircleCNR(Center=sdivide.Points, Normal=sdivide.Normals, Radius=division_3)
pshift = ShiftPaths(Data=circle, Offset=-1)
pull = PullCurve(Curve=pshift, Surface=subsrf_2)
srfsplit = SurfaceSplit(Surface=subsrf_2, Curves=pull)
area = Area(Geometry=srfsplit)  # -> Area, Centroid
sort = SortList(Keys=area.Area, ValuesA=srfsplit)  # -> Keys, reverse(ValuesA)
item_3 = ListItem(List=sort.ValuesA, Index=0, Wrap=True)
