# Grasshopper definition 199f3a9e3e5e720f12d11d9a07b4d18da397fd9f.ghx (Grasshopper 0.9.76)

list = ValueList({"World": 1, "Use x,y,z coordinates from Z List": 2}, selected="World")

# ----
# Demo box control
number_slider = Slider(20, range=1..20)

# ----
# Test plane Z dir coord
number_slider_2 = Slider(0.21, range=-1..1)

# ----
# by the Lord
# Set Plane size to 20
image = ImageSampler(
    FilePath="C:\Users\lilalaptop\AppData\Roaming\Grasshopper\UserObjects\PETER_OBJECTS\images\me.JPG",
    Filter="Colour",
    Interpolate=False,
    Umax=380,
    Umin=1,
    Vmax=406,
    Vmin=1,
    Wrap=1)
# Vector games
c_script = CSharpScript(
    boxMode=list,
    x=number_slider,
    y=Slider(20, range=1..20),
    z=Slider(20, range=1..20),
    Z=[Slider(-1, range=-1..1), Slider(-0.41, range=-1..1), Slider(-0.16, range=-1..1)],
    R=Slider(0.39, range=0.1..1),
    tpZ=[number_slider_2, Slider(0.21, range=-1..1), Slider(0.21, range=-1..1)],
    ampl=Slider(20.5, range=1..30))  # -> out, orientedBoxWireframe, boxArrowsXYZ, testPlane, testPlaneOrigin, boxP0, projPlaneZVectors, projPlaneZAngles, planeZDirAtBoxP0; inputs boxMode: Int32, x: Double, y: Double, z: Double, Z: list of Double, R: Double, tpZ: list of Double, ampl: Double
# ---------- c_script: C# ----------
    Box box = Box.Unset;
    List <Brep> boxArrows = new List<Brep>();
    List <Plane> boxPlanes = new List<Plane>();
    Point3d boxOrig = Point3d.Unset;

    MakeBox(boxMode, ref box, ref boxArrows, ref boxPlanes, x, y, z, R, Z, ref bW, ref boxOrig);
    orientedBoxWireframe = bW;  //>> out
    boxArrowsXYZ = boxArrows;   //>> out
    boxP0 = boxOrig;            //>> out

    Point3d orig = new Point3d(0, 0, 0);
    Plane plane = new Plane(orig, new Vector3d(tpZ[0], tpZ[1], tpZ[2]));
    Vector3d planeZ = plane.ZAxis; planeZ *= ampl;
    testPlane = plane;          //>> out
    testPlaneOrigin = orig;     //>> out
    planeZDirAtBoxP0 = planeZ;  //>> out

    List<Vector3d> projV = new List<Vector3d>();
    List<double> projA = new List<double>();

    foreach(Plane boxPlane in boxPlanes){
      Vector3d v = ProjectVectorToPlane(planeZ, boxPlane);
      projV.Add(v);
      double angle = Math.Round(RhinoMath.ToDegrees(Vector3d.VectorAngle(planeZ, v)), 2);
      projA.Add(angle);
    }
    projPlaneZVectors = projV; //>> out
    projPlaneZAngles = projA;  //>> out
# ---------- c_script: C# additional code ----------
  public Curve[] bW;

  public void MakeBox(int boxMode, ref Box box, ref List <Brep> boxArrows, ref List <Plane> boxPlanes,
  double x, double y, double z, double R, List<double> Z, ref Curve[] bW, ref Point3d boxO){

    Interval ix = new Interval(-x / 2.0, x / 2.0);
    Interval iy = new Interval(-y / 2.0, y / 2.0);
    Interval iz = new Interval(-z / 2.0, z / 2.0);

    Point3d orig = new Point3d(0, 0, 0);
    Vector3d planeZ = Vector3d.Unset;
    if(boxMode == 1) planeZ = new Vector3d(0, 0, 1); else planeZ = new Vector3d(Z[0], Z[1], Z[2]);

    Plane plane = new Plane(orig, planeZ);
    box = new Box(plane, ix, iy, iz);

    bW = box.ToBrep().GetWireframe(-1);
    Point3d[] p = box.GetCorners();
    boxO = p[0];

    boxArrows.Add(ArrowDir(p[0], p[1] - p[0], R, p[0].DistanceTo(p[1])));
    boxArrows.Add(ArrowDir(p[0], p[3] - p[0], R, p[0].DistanceTo(p[3])));
    boxArrows.Add(ArrowDir(p[0], p[4] - p[0], R, p[0].DistanceTo(p[4])));

    boxPlanes.Add(new Plane(p[0], p[1], p[3]));
    boxPlanes.Add(new Plane(p[0], p[3], p[4]));
    boxPlanes.Add(new Plane(p[0], p[1], p[4]));
  }

  private Brep ArrowDir(Point3d p0, Vector3d dir, double R, double L){
    dir.Unitize();
    Point3d p1 = p0 + dir * L;
    LineCurve rail = new LineCurve(p0, p1);
    Brep tube = Brep.CreatePipe(rail, R, false, PipeCapMode.Flat, false, 0.01, 0.01)[0];
    Cone cone = new Cone(new Plane(p1 + dir * L * 0.3, -dir), L * 0.3, R * 1.3);
    Brep coneB = cone.ToBrep(true);
    Brep north = Brep.CreateBooleanUnion(new Brep[2]{tube,coneB}, 0.01)[0];
    return north;
  }

  public Vector3d ProjectVectorToPlane (Vector3d v, Plane plane){
    Point3d p = plane.Origin + v;
    double tx,ty; plane.ClosestParameter(p, out tx, out ty);
    return plane.XAxis * tx + plane.YAxis * ty;
  }
# ---------- end c_script ----------
proj_on_box_xy_yz_xz_angles = Panel(c_script.projPlaneZAngles)

preview = CustomPreview(
    Geometry=c_script.boxArrowsXYZ,
    Shader=[ColourSwatch(SwatchColor=RGB(255, 0, 0)), ColourSwatch(SwatchColor=RGB(0, 255, 0)), ColourSwatch(SwatchColor=RGB(0, 10, 255))])
preview_2 = CustomPreview(Geometry=c_script.orientedBoxWireframe, Shader=ColourSwatch(SwatchColor=RGB(255, 255, 255)))
preview_3 = CustomPreview(Geometry=c_script.testPlane, Shader=ColourSwatch(SwatchColor=RGB(0, 10, 255)))
vdis = VectorDisplay(Anchor=c_script.testPlaneOrigin, Vector=c_script.planeZDirAtBoxP0)
vdis_2 = VectorDisplay(Anchor=c_script.boxP0, Vector=[c_script.projPlaneZVectors, c_script.planeZDirAtBoxP0])

# ----
# do you trust The Lord?
addition = Addition(A=c_script.boxP0, B=c_script.projPlaneZVectors)
addition_2 = Addition(A=c_script.boxP0, B=c_script.planeZDirAtBoxP0)
angledim = AngularDimension(Center=c_script.boxP0, PointA=addition_2, PointB=addition, Reflex=False, Text="{0:0.0}°", Size=1)
