# Grasshopper definition 19e433ac23bab214d2c44f064f7f321f078c52e0.ghx (Grasshopper 1.0.7)
# plug-ins: Bifocals

surface = Surface(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)
# Pablo Anastacio Mora Chatski
# pmora1990@gmail.com
# www.pablomora.xyz
# www.issuu.com/pablomorachatski
curve = Curve(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)
# This is how I want it to look like
image_gallery = ImageGallery(CycleDelay=30, Randomize=False, UseLocalImages=True, UseRemoteImages=True)
ghpython_script = GhPythonScript(curve_id=curve, surface_id=surface)  # -> out, curve_id, surface_id, Lines, listlines
# ---------- ghpython_script: Python ----------
#!/usr/bin/env python
# -*- coding: utf-8 -*-
import rhinoscriptsyntax as rs


def main():
    
    lines = []
    #You need a list to store each generated line
    
    #surface_id = rs.GetObject("Select a surface to sample", 8, True)#select surface
    #if not surface_id: return #if not surface, it will not continue
    #curve_id = rs.GetObject("Select a curve to measure", 4, True, True)#select curve
    #if not curve_id: return #if not curve, it will not continue
    points = rs.DivideCurve(curve_id, 100) #divide curve in 500 Segments
    #rs.EnableRedraw(False)
    
    
    for point in points:
        line = evaluatedeviation(surface_id, 2.0, point)#calls evaluatedeviation function
        lines.append(line)
    #rs.EnableRedraw(True)
    return lines


def evaluatedeviation( surface_id, threshold, sample ):
    r2point = rs.SurfaceClosestPoint(surface_id, sample)#Returns the UV parameter of the point on a surface that is closest to a test point.
    if not r2point: return
    
    r3point = rs.EvaluateSurface(surface_id, r2point[0], r2point[1])#evaluates the surface with UV parameters(U=[0] and v[1])
    if not r3point: return
    
    deviation = rs.Distance(r3point, sample)#sample refers to the previous point
    
    if deviation<=threshold: return#if deviation is less than threshold do nothing
    
    newpoints = rs.AddPoint(sample)#if deviation is more than threshold add point
    print "point added"
    line = rs.AddLine(sample, r3point)#if deviation is more than threshold add line
    print "line added"
    return line

if __name__=="__main__":
    Lines = main()
# ---------- end ghpython_script ----------
crv = Curve(ghpython_script.Lines)
# This is the script used in Rhinoceros
# #!/usr/bin/env python
# # -*- coding: utf-8 -*-
# import rhinoscriptsyntax as rs
# def main():
#     surface_id = rs.GetObject("Select a surface to sample", 8, True)#select surface
#     if not surface_id: return #if not surface, it will not continue
#     curve_id = rs.GetObject("Select a curve to measure", 4, True, True)#select curve
#     if not curve_id: return #if not curve, it will not continue
#     points = rs.DivideCurve(curve_id, 500) #divide curve in 500 Segments
#     rs.EnableRedraw(False)
#     for point in points: evaluatedeviation(surface_id, 5.0, point)#calls evaluatedeviation function
#     rs.EnableRedraw(True)
# def evaluatedeviation( surface_id, threshold, sample ):
#     r2point = rs.SurfaceClosestPoint(surface_id, sample)#Returns the UV parameter of the point on a surface that is closest to a test point.
#     if not r2point: return
#     r3point = rs.EvaluateSurface(surface_id, r2point[0], r2point[1])#evaluates the surface with UV parameters(U=[0] and v[1])
#     if not r3point: return
#     deviation = rs.Distance(r3point, sample)#sample refers to the previous point
#     if deviation<=threshold: return#if deviation is less than threshold do nothing
#     rs.AddPoint(sample)#if deviation is more than threshold add point
#     rs.AddLine(sample, r3point)#if deviation is more than threshold add line
# if __name__=="__main__":
#     main()
panel = Panel(ghpython_script.Lines)
panel_2 = Panel(ghpython_script.out)
