# Grasshopper definition 23084436544e6fd9dfb9b4ddaa3ad7bc5025f7d4.ghx (Grasshopper 1.0.7)

crv = Curve([<curve referenced from the Rhino model> x4])
crv_2 = Curve([<curve referenced from the Rhino model> x4])
crv_3 = Curve(<curve referenced from the Rhino model>)
end = EndPoints(Curve=crv_3)  # -> Start, End
end_2 = EndPoints(Curve=[crv, crv_2])  # -> Start, End
lng = ListLength(List=crv_2)
vec2pt = Vector2Pt(PointA=end.End, PointB=end.Start, Unitize=False)  # -> Vector, Length
pt = Point(end_2.Start)
pt_2 = Point(end_2.End)
extr = Extrude(Base=crv, Direction=vec2pt.Vector)
split = SplitList(List=pt, Index=lng)  # -> ListA, ListB
split_2 = SplitList(List=pt_2, Index=lng)  # -> ListA, ListB
series = Series(Start=0, Step=1, Count=lng)
series_2 = Series(Start=0, Step=1, Count=lng)
pt_3 = Point(split.ListA)
pt_4 = Point(split.ListB)
pt_5 = Point(split_2.ListA)
pt_6 = Point(split_2.ListB)
item = ListItem(List=pt_4, Index=series, Wrap=True)
item_2 = ListItem(List=pt_6, Index=series_2, Wrap=True)
crv_4 = Curve(<curve referenced from the Rhino model>)
relay = Relay([Slider(3.7, range=0..10), Slider(3.9, range=0..10), Slider(4.1, range=0..10), Slider(4.3, range=0..10)])
panel = Panel(relay)
relay_2 = Relay([Slider(3.9, range=0..10), Slider(4.1, range=0..10), Slider(4.3, range=0..10), Slider(4.5, range=0..10)])
panel_2 = Panel(relay_2)
end_3 = EndPoints(Curve=crv_4)  # -> Start, End
Z = UnitZ(Factor=relay)
Z_2 = UnitZ(Factor=relay_2)
move = Move(Geometry=item, Motion=Z)  # -> Geometry, Transform
move_2 = Move(Geometry=item_2, Motion=Z_2)  # -> Geometry, Transform
vec2pt_2 = Vector2Pt(PointA=end_3.End, PointB=end_3.Start, Unitize=False)  # -> Vector, Length
pt_7 = Point(graft(pt_4))
pt_8 = Point(graft(move.Geometry))
project = ProjectPoint(Point=move.Geometry, Direction=vec2pt_2.Vector, Geometry=extr)  # -> graft(Point), Index
pt_9 = Point(graft(pt_3))
pt_10 = Point(graft(pt_6))
pt_11 = Point(graft(move_2.Geometry))
project_2 = ProjectPoint(Point=move_2.Geometry, Direction=vec2pt_2.Vector, Geometry=extr)  # -> graft(Point), Index
pt_12 = Point(graft(pt_5))
pline = PolyLine(Vertices=[pt_7, pt_8, project.Point, pt_9], Closed=False)  # -> flatten(Polyline)
number_slider = Slider(0.6, range=0..1)
pline_2 = PolyLine(Vertices=[pt_10, pt_11, project_2.Point, pt_12], Closed=False)  # -> flatten(Polyline)
series_3 = Series(Start=0, Step=1, Count=lng)
crv_5 = Curve(crv)
crv_6 = Curve(crv_2)
fillet = Fillet(Curve=pline, Radius=number_slider)
fillet_2 = Fillet(Curve=pline_2, Radius=number_slider)
item_3 = ListItem(List=crv_5, Index=series_3, Wrap=True)  # -> graft(Item)
item_4 = ListItem(List=crv_6, Index=series_3, Wrap=True)  # -> graft(Item)
item_5 = ListItem(List=fillet, Index=series_3, Wrap=True)
item_6 = ListItem(List=fillet_2, Index=series_3, Wrap=True)
merge = Merge(Data1=graft(item_5), Data2=graft(item_6))
loft = Loft(Curves=merge, Options={Adjust=False, Closed=False, LoftEnds=0, LoftSimp=0, LoftType=0, Rebuild=10, Refit=0.01})
