# Grasshopper definition 2a053065e8592f18c895dff39ead78d8e5d943ae.ghx (Grasshopper 1.0.7)

curve = Curve([<curve referenced from the Rhino model> x3])
curve_2 = Curve(<curve referenced from the Rhino model>)
loft = Loft(Curves=curve, Options={Adjust=False, Closed=False, LoftEnds=0, LoftSimp=0, LoftType=0, Rebuild=10, Refit=0.01})
patch = Patch(Curves=curve, Spans=20, Flexibility=3, Trim=False)
end_points = EndPoints(Curve=curve_2)  # -> Start, End
list_item = ListItem(List=curve, Index=0, Wrap=True)  # -> Item, Item1, Item2
brep_closest_point = BrepClosestPoint(Point=end_points.End, Brep=loft)  # -> Point, Normal, Distance
brep_closest_point_2 = BrepClosestPoint(Point=end_points.Start, Brep=loft)  # -> Point, Normal, Distance
join_curves = JoinCurves(Curves=[list_item.Item, list_item.Item2], Preserve=False)
surface_split = SurfaceSplit(Surface=patch, Curves=join_curves)
line = Line(StartPoint=end_points.Start, EndPoint=brep_closest_point_2.Point)
list_item_2 = ListItem(List=surface_split, Index=0, Wrap=True)  # -> Item, Item1
line_2 = Line(StartPoint=end_points.End, EndPoint=brep_closest_point.Point)
surface = Surface(list_item_2.Item1)
length = Length(Curve=line)
length_2 = Length(Curve=line_2)
sweep2 = Sweep2(Rail1=line, Rail2=line_2, Sections=curve_2, SameHeight=False)
panel = Panel(length)
panel_2 = Panel(length_2)
offset_surface = OffsetSurface(Surface=surface, Distance=panel_2, Retrim=True)
offset_surface_2 = OffsetSurface(Surface=surface, Distance=panel, Retrim=True)
