# Grasshopper definition 2eb4b750c941f9bbd32b7db0ad8cfcd5f78bf858.ghx (Grasshopper 1.0.7)
# plug-ins: Weaverbird, Kangaroo2 Components

arc = Arc(Plane=PlaneXY(0, 0, 0), Radius=Slider(42, range=0..100), Angle=Domain(0, 3.141592654))  # -> Arc, Length
end = EndPoints(Curve=arc.Arc)  # -> Start, End
number_slider = Slider(20, range=0..100)
ln = Line(StartPoint=end.Start, EndPoint=end.End)
loft = Loft(Curves=[arc.Arc, ln], Options={Adjust=False, Closed=False, LoftEnds=0, LoftSimp=0, LoftType=0, Rebuild=10, Refit=0.01})
mesh_uv = MeshSurface(Surface=loft, UCount=number_slider, VCount=number_slider, Overhang=True, Equalize=False)
medges = MeshEdges(Mesh=mesh_uv)  # -> NakedEdges, InteriorEdges, NonManifoldEdges
crv = Curve([medges.NakedEdges, medges.InteriorEdges])
len = Length(Curve=crv)
larger = LargerThan(FirstNumber=len, SecondNumber="0.01")  # -> LargerThan, OrEqualTo
cull = CullPattern(List=crv, CullPattern=larger.LargerThan)
wbweave = WeaverbirdsMeshFromLinesWeaveBack(Lines=cull, MaximumValence=4)
demesh = DeconstructMesh(Mesh=wbweave)  # -> Vertices, Faces, Colours, Normals
nv = NakedVertices(Mesh=wbweave)  # -> ClothedIndex, NakedIndex, ClothedPts, NakedPts
Z = UnitZ(Factor=Slider(0.363, range=0..2))
edgelengths = EdgeLengths(Mesh=wbweave, LengthFactor=Slider(0.49, range=0..1), Strength=1)
anchor = Anchor(Point=nv.NakedPts, Strength=10000)
load = Load(Point=demesh.Vertices, ForceVector=Z)
show = Show(G=wbweave)
entwine = Entwine(Branch00=show, Branch01=[load, edgelengths, anchor], FlattenInputs=True)
solver = Solver(GoalObjects=entwine, Reset=Button(), Threshold=1e-15, Tolerance=0.01, On=Toggle(True))  # -> I, V, O
bang = ExplodeTree(Data=solver.O)  # -> Branch0, Branch1
mesh = Mesh(bang.Branch0)
