# Grasshopper definition 2f3040ced78742d04de5a4421de5d32d00dc2be4.ghx (Grasshopper 1.0.7)
# plug-ins: NGon

number_slider = Slider(1, range=0..1)
brep = Brep(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)
hexdivide = HexDivide(
    Surface=brep,
    U=Slider(9, range=0..10),
    V=Slider(10, range=0..10),
    Parameter=0.25,
    Boundary=0,
    Swap=True,
    Rebuild=9,
    Quadrangulate=False)  # -> Mesh, DistA, DistB

# ---- group: Keep Track of merged extruded mesh and offset mesh
offsetmesh = OffsetMesh(Mesh=hexdivide.Mesh, Dist=expr("-1", number_slider), Solid=False)
extrude_edges = ExtrudeEdges(Mesh=hexdivide.Mesh, Dist=number_slider, Cap=False, Merge=invert(False), BothSides=False)
mjoin = MeshJoin(Meshes=[hexdivide.Mesh, offsetmesh])

# ----
planarize2 = Planarize2(
    Mesh=extrude_edges,
    Tangential=0.0001,
    Iterations=Slider(1000, range=0..1000),
    StaticSolver=invert(False),
    Run=invert(False),
    Reset=False)

# ---- group: Check if planar
getpolylines = GetPolylines(Mesh=planarize2)
boundary = BoundarySurfaces(Edges=getpolylines)

# ---- group: Adjust vertex positions
matchmesh = AdjustMeshVertices(MeshA=mjoin, MeshB=planarize2)

# ----
projectpairs = ProjectPairs(Mesh=matchmesh, Scale=Slider(1, range=0..1))

# ---- group: Display
weldmesh = WeldMesh(Mesh=projectpairs, Radius=Slider(-3, range=-10..-3))
