# Grasshopper definition 2f9702c8050895099267b17d09798926a2fbf1e4.ghx (Grasshopper 1.0.7)

number_slider = Slider(10, range=0..10)
number_slider_2 = Slider(9, range=0..100)
srf = Surface(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)
sdivide = DivideSurface(Surface=srf, UCount=number_slider, VCount=number_slider_2)  # -> Points, Normals, Parameters
divide = DivideDomain²(Domain=srf, UCount=number_slider, VCount=number_slider_2)
subsrf = Isotrim(Surface=srf, Domain=divide)
evalsrf = EvaluateSurface(Surface=reparameterize(subsrf), Point="{0.5,0.5,0}")  # -> Point, Normal, UDirection, VDirection, Frame
explode = Explode(Curve=subsrf, Recursive=True)  # -> Segments, Vertices
neg = Negative(Value=Slider(5, range=0..10))
amp = Amplitude(Vector=evalsrf.Normal, Amplitude=neg)
move = Move(Geometry=evalsrf.Point, Motion=amp)  # -> Geometry, Transform
partition = PartitionList(List=move.Geometry, Size=number_slider_2)
flip = FlipMatrix(Data=partition)
flip_2 = FlipMatrix(Data=sdivide.Points)
ln = Line(StartPoint=explode.Vertices, EndPoint=graft(move.Geometry))
intcrv = Interpolate(Vertices=flip, Degree=3, Periodic=False, KnotStyle=1)  # -> Curve, Length, Domain
intcrv_2 = Interpolate(Vertices=partition, Degree=3, Periodic=False, KnotStyle=1)  # -> Curve, Length, Domain
intcrv_3 = Interpolate(Vertices=sdivide.Points, Degree=3, Periodic=False, KnotStyle=1)  # -> Curve, Length, Domain
intcrv_4 = Interpolate(Vertices=flip_2, Degree=3, Periodic=False, KnotStyle=1)  # -> Curve, Length, Domain
pipe = Pipe(Curve=[intcrv_3.Curve, intcrv_4.Curve], Radius=Slider(0.457, range=0..2), Caps=2)
pipe_2 = Pipe(Curve=[intcrv.Curve, intcrv_2.Curve, ln], Radius=Slider(0.2, range=0..2), Caps=2)
preview = CustomPreview(Geometry=pipe, Material=ColourSwatch(SwatchColor=RGB(66, 101, 153)))
preview_2 = CustomPreview(Geometry=pipe_2, Material=ColourSwatch(SwatchColor=RGB(79, 132, 158)))
