# Grasshopper definition 312f1361a24e3fbe0c5697e09a7ca1bca9aa9f5d.ghx (Grasshopper 1.0.7)
# Copyright: 2019

motion_vectors = Line([Line((23, 15, 0), (30, 22, 26)), Line((-16, 10, 0), (-19, 14, 17)), Line((-25, -28, 0), (-5, -5, -5)), Line((3, -10, 0), (5, -10, -20)), Line((27, -33, 0), (28, -32, 24))])
mplane = MeshPlane(
    Boundary={Plane=PlaneXY(3.261963691, -8.351065643, 0), Size=Domain2(u=-30.79924167..30.79924167, v=-33.28711119..33.28711119)},
    WidthCount=60,
    HeightCount=60)  # -> Mesh, Area
vec = Vector(expr("x*0.5", motion_vectors))
end = EndPoints(Curve=motion_vectors)  # -> Start, End
demesh = DeconstructMesh(Mesh=mplane.Mesh)  # -> Vertices, Faces, Colours, Normals
dist = Distance(PointA=graft(demesh.Vertices), PointB=end.Start)
graph = GraphMapper(dist, x0=0, x1=20, y0=0, y1=1, container_name="Gaussian", factor=0.586956501, mean=0, sdev=0.2433862388)
multiplication = Multiplication(A=graph, B=vec)
ma = MassAddition(Input=multiplication)  # -> flatten(Result), PartialResults
move = Move(Geometry=demesh.Vertices, Motion=ma.Result)  # -> Geometry, Transform
conmesh = ConstructMesh(Vertices=move.Geometry, Faces=demesh.Faces)
