# Grasshopper definition 357b6857afdccecdcaabca7baacaf5aa45067c62.ghx (Grasshopper 1.0.7)

# ---- group: Connector shape
low_edge = Circle({Plane=Plane(origin=(0, 0, -5.070461033), x=(-0.07397462591, 0, 0.9972601239), y=(0.9972601239, 0, 0.07397462591)), Radius=5.082745509})
gap_edge = Circle({Plane=Plane(origin=(0.5109909613, 0, -0.1888813129), x=(-0.9571726275, 0, 0.289517808), y=(-0.289517808, 0, -0.9571726275)), Radius=0.6874818518})
thickness = Slider(0.1, range=0.05..0.5)
boundary = Rectangle({Plane=PlaneXZ(0, 0, 0.5), Size=Domain2(u=-3..3, v=-1.5..1.5)})
top_edge = Circle({Plane=Plane(origin=(0, 0, 5.761055389), x=(-0.1256569833, 0, -0.9920737485), y=(0.9920737485, 0, -0.1256569833)), Radius=5.082745509})
rdiff = RegionDifference(CurvesA=boundary, CurvesB=[top_edge, low_edge, gap_edge], Plane=boundary)
srf = Surface(rdiff)
Y = UnitY(Factor=thickness)
extr = Extrude(Base=srf, Direction=Y)
rotax = RotateAxis(Geometry=extr, Angle=degrees(Slider(30, range=0..80)), Axis=Line((0, 0, 0), (10, 0, 0)))  # -> Geometry, Transform

# ---- group: Box limits
circle = Circle({Plane=Plane(origin=(1.014865992, 0, 1.353846035), x=(-0.966775608, 0, -0.2556265318), y=(0.2556265318, 0, -0.966775608)), Radius=1.908333333})
circle_2 = Circle({Plane=Plane(origin=(-1.014865992, 0, 1.353846035), x=(0.966775608, 0, -0.2556265318), y=(0.2556265318, 0, 0.966775608)), Radius=1.908333333})

# ---- group: Allowed space
rint = RegionIntersection(CurvesA=circle, CurvesB=circle_2)
move = Move(Geometry=rint, Motion=Vector(0, -2, 0))  # -> Geometry, Transform
extr_2 = Extrude(Base=move.Geometry, Direction=Vector(0, 5, 0))
cap = CapHoles(Brep=extr_2)

# ----
sint = SolidIntersection(BrepsA=cap, BrepsB=rotax.Geometry)
