# Grasshopper definition 370c1bc4a50e275e635154af672693b50ee5b126.ghx (Grasshopper 1.0.7)

pt = Point(Point(255, 0, 0))

# ---- group: Basic grid
number_slider = Slider(3, range=0..10)
number_slider_2 = Slider(160, range=0..200)
recgrid = Rectangular(Plane=pt, SizeX=number_slider, SizeY=number_slider, ExtentX=number_slider_2, ExtentY=number_slider_2)  # -> Cells, Points

# ---- group: Boundary curve
crv = Curve(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)

# ---- group: Test points for inclusion
incurve = PointInCurve(Point=recgrid.Points, Curve=crv)  # -> Relationship, Point
equals = Equality(FirstNumber=incurve.Relationship, SecondNumber="2")  # -> Equality, Inequality

# ----
boundary = BoundarySurfaces(Edges=crv)
sift = SiftPattern(List=recgrid.Points, SiftPattern=equals.Equality)  # -> Output0, Output1
srf_cp = SurfaceClosestPoint(Point=sift.Output1, Surface=reparameterize(boundary))  # -> Point, UVPoint, Distance
image = ImageSampler(
    srf_cp.UVPoint,
    FilePath="F:\Data Archive-01_3D\05-Rhino & Plugins\02_Grasshopper\01_Definition Library\08_Image Sampling\3d-black-and-white-twirl.jpg",
    Filter="Value",
    Interpolate=False,
    Umax=1,
    Umin=0,
    Vmax=1,
    Vmin=0,
    Wrap=1)
dom = ConstructDomain(DomainStart=0, DomainEnd=Slider(14.344, range=0..30))
remap = RemapNumbers(Value=image, Source=Domain(0, 1), Target=dom)  # -> Mapped, Clipped
Z = UnitZ(Factor=remap.Mapped)
move = Move(Geometry=sift.Output1, Motion=Z)  # -> Geometry, Transform
combine = CombineData(Input0=sift.Output0, Input1=move.Geometry)  # -> Result, Index

# ---- group: Draw a curve with the points
nurbs = NurbsCurve(Vertices=combine.Result, Degree=3, Periodic=False)  # -> Curve, Length, Domain
