# Grasshopper definition 3bb6131200982e56b8bb8d5822b1981488e709aa.ghx (Grasshopper 1.0.7)
# plug-ins: Weaverbird

pt = ConstructPoint(XCoordinate=0, YCoordinate=0, ZCoordinate=0)
pt_2 = ConstructPoint(XCoordinate=0, YCoordinate=0, ZCoordinate=0)
xz = XZPlane(Origin=Point(0, 0, 0))
dom = ConstructDomain(DomainStart="-5", DomainEnd="5")
dom_2 = ConstructDomain(DomainStart="-5", DomainEnd="5")
xz_2 = XZPlane(Origin=Point(0, 0, 0))
dom_3 = ConstructDomain(DomainStart="-5", DomainEnd="5")
rectangle = Rectangle(Plane=xz, XSize=Slider(5, range=0..10), YSize=dom_2, Radius=0)  # -> Rectangle, Length
rectangle_2 = Rectangle(Plane=PlaneXY(0, 0, 0), XSize=dom, YSize=dom, Radius=0)  # -> Rectangle, Length
rectangle_3 = Rectangle(Plane=xz_2, XSize=Slider(5, range=0..10), YSize=dom_3, Radius=0)  # -> Rectangle, Length
boundary = BoundarySurfaces(Edges=rectangle.Rectangle)
boundary_2 = BoundarySurfaces(Edges=rectangle_2.Rectangle)
Z = UnitZ(Factor=Slider(0.6, range=0..2.2))
boundary_3 = BoundarySurfaces(Edges=rectangle_3.Rectangle)
Z_2 = UnitZ(Factor=Slider(0.6, range=0..2.2))
move = Move(Geometry=pt, Motion=Z)  # -> Geometry, Transform
arrpolar = PolarArray(Geometry=boundary, Plane=PlaneXY(0, 0, 0), Count=expr("x-1", Slider(10, range=0..10)), Angle=6.283185307)  # -> Geometry, Transform
move_2 = Move(Geometry=pt_2, Motion=Z_2)  # -> Geometry, Transform
arrpolar_2 = PolarArray(Geometry=boundary_3, Plane=PlaneXY(0, 0, 0), Count=expr("x-1", Slider(10, range=0..10)), Angle=6.283185307)  # -> Geometry, Transform
sph = Sphere(Base=move.Geometry, Radius="2.2")
sph_2 = Sphere(Base=move_2.Geometry, Radius="2.2")
split = SplitBrep(Brep=sph, Cutter=boundary_2)
item = ListItem(List=split, Index=Toggle(False), Wrap=False)
dom_4 = ConstructDomain(DomainStart="-5", DomainEnd="5")

bbx = BrepBrep(BrepA=arrpolar.Geometry, BrepB=item)  # -> Curves, Points
srfsplit = SurfaceSplit(Surface=item, Curves=flatten(bbx.Curves))

popgeo = PopulateGeometry(Geometry=sph_2, Count=Slider(200, range=0..200), Seed=Slider(77, range=0..100))
rectangle_4 = Rectangle(Plane=PlaneXY(0, 0, 0), XSize=dom_4, YSize=dom_4, Radius=0)  # -> Rectangle, Length
facet = FacetDome(Points=popgeo)  # -> Pattern, Dome
boundary_4 = BoundarySurfaces(Edges=rectangle_4.Rectangle)
boundary_5 = BoundarySurfaces(Edges=facet.Pattern)
popgeo_2 = PopulateGeometry(Geometry=sph, Count=Slider(200, range=0..200), Seed=Slider(77, range=0..100))
join = BrepJoin(Breps=boundary_5)  # -> Breps, Closed
bbox = BoundingBox(Content=sph, Plane=PlaneXY(0, 0, 0))  # -> Box, Box_2
split_2 = SplitBrep(Brep=join.Breps, Cutter=boundary_4)
voronoi³ = Voronoi3D(Points=popgeo_2, Box=bbox.Box)  # -> Cells, Boundary
bbx_2 = BrepBrep(BrepA=item, BrepB=voronoi³.Cells)  # -> Curves, Points
item_2 = ListItem(List=srfsplit, Index=Slider(11, range=0..100), Wrap=True)
item_3 = ListItem(List=split_2, Index=0, Wrap=True)
debrep = DeconstructBrep(Brep=item_3)  # -> Faces, Edges, Vertices
srfsplit_2 = SurfaceSplit(Surface=item, Curves=flatten(bbx_2.Curves))
area = Area(Geometry=item_2)  # -> Area, Centroid
disc = Discontinuity(Curve=debrep.Faces, Level=1)  # -> Points, Parameters
planar = IsPlanar(Surface=debrep.Faces, Interior=True)  # -> Planar, Plane
sdivide = DivideSurface(Surface=item_2, UCount=Slider(200, range=0..200), VCount=Slider(100, range=0..200))  # -> Points, Normals, Parameters
area_2 = Area(Geometry=srfsplit_2)  # -> Area, Centroid
md_slider = MDSlider(
    SliderMode=0,
    slider_value=Point(0.5020599365, 0.4978319978, 0.5),
    x_domain=Domain(0, 1),
    y_domain=Domain(0, 1),
    z_domain=Domain(0, 1))
disc_2 = Discontinuity(Curve=bbx_2.Curves, Level=1)  # -> Points, Parameters
amp = Amplitude(Vector=planar.Plane, Amplitude=Slider(0.25, range=0..1))
avr = Average(Input=disc.Points)
circle = CircleCNR(Center=sdivide.Points, Normal=sdivide.Normals, Radius=Slider(0.02, range=0..1))
evalsrf = EvaluateSurface(Surface=reparameterize(srfsplit_2), Point=md_slider)  # -> Point, Normal, Frame
move_3 = Move(Geometry=avr, Motion=graft(amp))  # -> Geometry, Transform
scale = Scale(Geometry=circle, Center=Point(0, 0, 0), Factor=0.5)  # -> Geometry, Transform
move_4 = Move(Geometry=area_2.Centroid, Motion=evalsrf.Normal)  # -> graft(Geometry), Transform
merge = Merge(Data1=simplify(disc.Points), Data2=simplify(move_3.Geometry))
del = DelaunayMesh(Points=merge, Plane=graft(planar.Plane))
merge_2 = Merge(Data1=disc_2.Points, Data2=move_4.Geometry)
wbjoin = WeaverbirdsJoinMeshesAndWeld(Mesh=flatten(del), Weld=False)
del_2 = DelaunayMesh(Points=merge_2, Plane=PlaneXY(0, 0, 0))
wbcatmullclark = WeaverbirdsCatmullClarkSubdivision(MeshCurves=wbjoin, Level=Slider(3, range=0..10), SmoothNakedEdges="0")
