# Grasshopper definition 49b10d1c31bcdab4e910329cd364d93dd6d68bf1.ghx (Grasshopper 1.0.7)

# ---- group: Create all the rays (3 points * 10 vectors)
points = Point(graft([Point(16, -8, 1), Point(11, -3, 11), Point(-1, -5, 5)]))
rays = Vector([Vector(1, 2, 0), Vector(0.6375113977, 2.143263684, 0), Vector(0.2556523341, 2.221405385, 0), Vector(-0.1339745962, 2.232050808, 0), Vector(-0.5195307763, 2.174876496, 0), Vector(-0.8893012766, 2.051619662, 0), Vector(-1.232050808, 1.866025404, 0), Vector(-1.537365098, 1.623732907, 0), Vector(-1.795967328, 1.332104108, 0), Vector(-2, 1, 0)])
lng = ListLength(List=rays)
repeat = RepeatData(Data=points, Length=lng)
line = LineSDL(Start=repeat, Direction=rays, Length=2)  # -> simplify(graft(Line))

# ----
# - Four meshes
# - Three points
# - Ten rays each
# 
# We have to intersect *each* mesh with *all* rays.
shapes = Mesh([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])
end = EndPoints(Curve=line)  # -> Start, End
# This null here means that
# the first mesh did *not*
# intersect with the first ray
# from the first point.
# Mesh index
meshray = MeshRay(Mesh=shapes, Point=end.Start, Direction=line)  # -> Point, Hit
# Point index
# Ray index
panel = Panel(meshray.Point)
