# Grasshopper definition 4d9c06de033fdbfe4ad38edaafae6efea1059b0d.ghx (Grasshopper 0.9.76)
# plug-ins: Python Interpreter

python = PythonScript()  # -> Ham, Spam
# ---------- python: Python ----------
"""
Main component documentation here.
    Inputs:
        Foo: Is not Fu-Fu {access,type}
        Bar: Might be a Mars or a Snicker {access,type}
    Outputs:
        Ham: Is a form of meat
        Spam: Is a not meat
    Remarks:
        Author: Anders Holden Deleuran (BIG Ideas/Compute)
        Project:
        License:
        Version: 181015
"""
# ---------- end python ----------
