# Grasshopper definition 4e7e2d24d96cb0d1ebc6b7e3e6a102c4f365767d.ghx (Grasshopper 1.0.7)

data = Data(Tree({1;0}: [Point(0, 0, 0), Point(0, 1, 0), Point(0, 2, 0), Point(0, 3, 0), Point(0, 4, 0), Point(0, 5, 0), Point(0, 6, 0), Point(0, 7, 0), Point(0, 8, 0), Point(0, 9, 0), Point(0, 10, 0), Point(0, 11, 0), Point(0, 12, 0), Point(0, 13, 0), Point(0, 14, 0), Point(0, 15, 0), Point(0, 16, 0), Point(0, 17, 0), Point(0, 18, 0), Point(0, 19, 0), Point(0, 20, 0), Point(0, 21, 0), Point(0, 22, 0), Point(0, 23, 0)], {2;0}: [Point(1, 0, 0), Point(1, 1, 0), Point(1, 2, 0), Point(1, 3, 0), Point(1, 4, 0), Point(1, 5, 0), Point(1, 6, 0), Point(1, 7, 0), Point(1, 8, 0), Point(1, 9, 0), Point(1, 10, 0), Point(1, 11, 0), Point(1, 12, 0), Point(1, 13, 0), Point(1, 14, 0), Point(1, 15, 0), Point(1, 16, 0), Point(1, 17, 0), Point(1, 18, 0), Point(1, 19, 0), Point(1, 20, 0), Point(1, 21, 0), Point(1, 22, 0), Point(1, 23, 0)]))
number_slider = Slider(10, range=0..10)
lng = ListLength(List=data)
expression = Expression(x=number_slider, Expression="Format(\"{{?;<{0}}}\" ,x)")
division = Division(A=lng, B=number_slider)
partition = PartitionList(List=data, Size=division)  # -> simplify(Chunks)
split = SplitTree(Data=partition, Masks=flatten(expression))  # -> Positive, Negative
trim = TrimTree(Tree=split.Negative, Depth=1)
tstat = TreeStatistics(Tree=trim)  # -> Paths, Length, Count
lng_2 = ListLength(List=tstat.Paths)
tstat_2 = TreeStatistics(Tree=split.Positive)  # -> Paths, Length, Count
series = Series(Start=expr("x-1", number_slider), Step=number_slider, Count=lng_2)
item = ListItem(List=tstat_2.Paths, Index=series, Wrap=invert(True))
viewer = ParamViewer(data)
replace = ReplacePaths(Data=trim, Search=tstat.Paths, Replace=item)
merge = Merge(Data1=split.Positive, Data2=replace)
viewer_2 = ParamViewer(merge)
