# Grasshopper definition 4fcb5965f6a8735afe8a4c126bd343ece6021e84.ghx (Grasshopper 1.0.7)

crv = Curve(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)
crv_2 = Curve(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)
divide = DivideCurve(Curve=crv, Count=Slider(50, range=0..50), Kinks=False)  # -> Points, Tangents, Parameters
crv_cp = CurveClosestPoint(Point=divide.Points, Curve=crv_2)  # -> Point, Parameter, Distance
number_slider = Slider(96, range=0..500)
cullpt = CullDuplicates(Points=crv_cp.Point, Tolerance=0.01, CullMode=1)  # -> Points, Indices, Valence
short = ShortestList(ListA=divide.Points, ListB=cullpt.Points, TrimMode=1)  # -> ListA, ListB
points = PointList(Points=cullpt.Points, Size=number_slider)
points_2 = PointList(Points=divide.Points, Size=number_slider)
ln = Line(StartPoint=short.ListA, EndPoint=short.ListB)
len = Length(Curve=ln)
sort = SortList(Keys=len, ValuesA=ln)  # -> Keys, ValuesA
data = Data(len)
bnd = Bounds(Numbers=data)
panel = Panel(bnd)
linedim = LineDimension(Line=ln, Text="{0:0.00}", Size=Slider(100, range=0..100))
item = ListItem(List=reverse(sort.ValuesA), Index=0, Wrap=True)
