# Grasshopper definition 51e062c5175233cbf30634ee55e513e3f20facd7.ghx (Grasshopper 0.9.80)

base_curve = JoinCurves(Curves=[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], Preserve=False)

panel = Panel("Transformation")
floor_height = Slider(3.5, range=0..10)
no_of_floors = Slider(50, range=0..100)
_0 = Integer(0)
series = Series(Start=_0, Step=floor_height, Count=no_of_floors)
panel_2 = Panel("Extrapolate floors")
unit_z = UnitZ(Factor=series)
move = Move(Geometry=base_curve, Motion=unit_z)  # -> Geometry, Transform
floor_rotation_ground = Slider(-180, range=-180..180)
floor_rotaton_top = Slider(180, range=-180..180)
construct_domain = ConstructDomain(DomainStart=floor_rotation_ground, DomainEnd=floor_rotaton_top)
series_2 = Series(Start=0, Step=1, Count=no_of_floors)
bounds = Bounds(Numbers=series_2)
panel_3 = Panel("Rotate floors")
remap_numbers = RemapNumbers(Value=series_2, Source=bounds, Target=construct_domain)  # -> Mapped, Clipped
graph_mapper = GraphMapper(
    remap_numbers.Mapped,
    x0=-180,
    x1=180,
    y0=-180,
    y1=180,
    container_name="Bezier",
    cpx=[0, 0.01086956542, 0.4855072498, 1],
    cpy=[0, 0.7137681246, 1, 1])
radians = Radians(Degrees=graph_mapper)
rotate = Rotate(Geometry=move.Geometry, Angle=radians, Plane=PlaneXY(0, 0, 0))  # -> Geometry, Transform

panel_4 = Panel("Surface")
floor_thickness = Slider(0.2, range=0..0.5)
boundary_surfaces = BoundarySurfaces(Edges=rotate.Geometry)
unit_z_2 = UnitZ(Factor=floor_thickness)
panel_5 = Panel("Floor plates")
move_2 = Move(Geometry=rotate.Geometry, Motion=unit_z_2)  # -> Geometry, Transform
extrude = Extrude(Base=boundary_surfaces, Direction=unit_z_2)
custom_preview = CustomPreview(Geometry=extrude, Shader=ColourSwatch(SwatchColor=RGB(255, 255, 255)))
area = Area(Geometry=move_2.Geometry)  # -> Area, Centroid
rotate_plane = RotatePlane(Plane=area.Centroid, Angle=radians)
panel_6 = Panel("Divide curves")
points_on_curve = Slider(20, range=0..20)
scale_nu = ScaleNU(Geometry=move_2.Geometry, Plane=rotate_plane, ScaleX=1, ScaleY=1, ScaleZ=1)  # -> flatten(Geometry), Transform
divide_curve = DivideCurve(Curve=scale_nu.Geometry, Count=points_on_curve, Kinks=False)  # -> simplify(Points), Tangents, Parameters
flip_matrix = FlipMatrix(Data=divide_curve.Points)
cull_pattern = CullPattern(List=flip_matrix, CullPattern=[False, True, False, True])
shift_list = ShiftList(List=cull_pattern, Shift=1, Wrap=True)  # -> simplify(List)
shift_list_2 = ShiftList(List=cull_pattern, Shift=-1, Wrap=True)  # -> simplify(List)
flip_matrix_2 = FlipMatrix(Data=shift_list)  # -> simplify(Data)
flip_matrix_3 = FlipMatrix(Data=cull_pattern)  # -> simplify(Data)
flip_matrix_4 = FlipMatrix(Data=shift_list_2)  # -> simplify(Data)
panel_7 = Panel("Panel surface")
list_length = ListLength(List=flip_matrix_3)  # -> expr("x-1", Length)
list_length_2 = ListLength(List=flip_matrix_2)  # -> expr("x-1", Length)
split_list = SplitList(List=flip_matrix_3, Index=list_length)  # -> simplify(ListA), ListB
split_list_2 = SplitList(List=flip_matrix_2, Index=list_length_2)  # -> simplify(ListA), ListB
shift_list_3 = ShiftList(List=flip_matrix_3, Shift=1, Wrap=False)  # -> simplify(List)
shift_list_4 = ShiftList(List=flip_matrix_4, Shift=1, Wrap=False)  # -> simplify(List)
_4point_surface = _4PointSurface(CornerA=split_list.ListA, CornerB=split_list_2.ListA, CornerC=shift_list_3)
_4point_surface_2 = _4PointSurface(CornerA=shift_list_3, CornerB=shift_list_4, CornerC=split_list.ListA)
flip_matrix_5 = FlipMatrix(Data=_4point_surface)
flip_matrix_6 = FlipMatrix(Data=_4point_surface_2)
flip_matrix_7 = FlipMatrix(Data=_4point_surface)
flip_matrix_8 = FlipMatrix(Data=_4point_surface_2)
cull_pattern_2 = CullPattern(List=flip_matrix_5, CullPattern=[True, False])
cull_pattern_3 = CullPattern(List=flip_matrix_6, CullPattern=[False, True])
cull_pattern_4 = CullPattern(List=flip_matrix_7, CullPattern=[False, True])
cull_pattern_5 = CullPattern(List=flip_matrix_8, CullPattern=[True, False])
colour_swatch = ColourSwatch(SwatchColor=RGB(60, 60, 62))
colour_swatch_2 = ColourSwatch(SwatchColor=RGBA(103, 137, 138, 135))
custom_preview_2 = CustomPreview(Geometry=[cull_pattern_2, cull_pattern_3], Shader=colour_swatch)
custom_preview_3 = CustomPreview(Geometry=[cull_pattern_4, cull_pattern_5], Shader=colour_swatch_2)
interpolate = Interpolate(Vertices=flip_matrix, Degree=3, Periodic=False, KnotStyle=1)  # -> Curve, Length, Domain
panel_8 = Panel("Mullions")
pipe = Pipe(Curve=interpolate.Curve, Radius=0.1, Caps=0)
custom_preview_4 = CustomPreview(Geometry=pipe, Shader=ColourSwatch(SwatchColor=RGB(255, 255, 255)))

# ----
# Select every Xth floor plate curve
# (span for fascade elements)
allfloorplatecrvs = Curve(flatten(scale_nu.Geometry))
every_xth_floor = Slider(2, range=1..10)
lng = ListLength(List=allfloorplatecrvs)
division = Division(A=lng, B=every_xth_floor)
series_3 = Series(Start=" 1", Step=every_xth_floor, Count=division)
int = Integer(series_3)
item = ListItem(List=allfloorplatecrvs, Index=int, Wrap=True)
everyxthfloorplatecrv = Curve(flatten(item))

# ----
# Construct triangular fascade elements
# as curves and regroup them by floor span.
divide = DivideCurve(Curve=everyxthfloorplatecrv, Count=points_on_curve, Kinks=False)  # -> simplify(Points), Tangents, Parameters
relitem = RelativeItem(Tree=divide.Points, Offset=" {1}", WrapPaths=" True", WrapItems=False)  # -> ItemA, ItemB
shift = ShiftList(List=relitem.ItemA, Shift=" 1", Wrap=" True")  # -> simplify(graft(List))
graft = GraftTree(Tree=relitem.ItemA, IncludeEmptyLists=True, IncludeNullItems=True)
graft_2 = GraftTree(Tree=relitem.ItemB, IncludeEmptyLists=True, IncludeNullItems=True)
shift_2 = ShiftList(List=relitem.ItemB, Shift=" 1", Wrap=" True")  # -> simplify(graft(List))
merge = Merge(Data1=graft, Data2=shift, Data3=graft_2)
merge_2 = Merge(Data1=shift, Data2=shift_2, Data3=graft_2)
pline = PolyLine(Vertices=merge, Closed=" True")
pline_2 = PolyLine(Vertices=merge_2, Closed=" True")
merge_3 = Merge(Data1=pline, Data2=pline_2)
pshift = ShiftPaths(Data=merge_3, Offset=-1)
fascadeelementsbyfloorspancrvs = Curve(pshift)

# ----
# Differentiate between windows and panels
# Windows
# Panels
tstat = TreeStatistics(Tree=fascadeelementsbyfloorspancrvs)  # -> Paths, Length, Count
lng_2 = ListLength(List=tstat.Paths)
lng_3 = ListLength(List=tstat.Paths)
division_2 = Division(A=lng_2, B=" 2")
division_3 = Division(A=lng_3, B=" 2")
series_4 = Series(Start=" 1", Step=" 2", Count=division_2)
series_5 = Series(Start=" 0", Step=" 2", Count=division_3)
int_2 = Integer(series_4)
int_3 = Integer(series_5)
branch = TreeBranch(Tree=fascadeelementsbyfloorspancrvs, Path=int_3, MaintainPaths=True)
branch_2 = TreeBranch(Tree=fascadeelementsbyfloorspancrvs, Path=int_2, MaintainPaths=True)
boundary = BoundarySurfaces(Edges=branch_2)
boundary_2 = BoundarySurfaces(Edges=branch)
windowsrfs = Surface(boundary)
panelsrfs = Surface(boundary_2)
preview = CustomPreview(Geometry=windowsrfs, Shader=colour_swatch_2)
preview_2 = CustomPreview(Geometry=panelsrfs, Shader=colour_swatch)
