# Grasshopper definition 5710afbf1b46c75c067f5877776d29c1ce59ffb5.ghx (Grasshopper 1.0.7)

slider = Slider(20, range=0..50)
slider_2 = Slider(20, range=0..50)
crv = Curve(reparameterize(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))
_0 = Parameter(0)
_2 = Parameter(2)
pframe = PerpFrame(Curve=crv, Parameter=_0)
division = Division(A=slider, B=_2)
division_2 = Division(A=slider_2, B=_2)
division_3 = Division(A=slider, B=_2)
division_4 = Division(A=slider_2, B=_2)
neg = Negative(Value=division_3)
neg_2 = Negative(Value=division_4)
pt = PointOriented(System=pframe, XComponent=division, YComponent=division_2, ZComponent=0)
pt_2 = PointOriented(System=pframe, XComponent=neg, YComponent=neg_2, ZComponent=0)
rec_2pt = Rectangle2Pt(Plane=pframe, PointA=pt, PointB=pt_2, Radius=Slider(0, range=0..10))  # -> Rectangle, Length
python = GhPythonScript(R=crv, S=rec_2pt.Rectangle)  # -> out, a; inputs R: Curve, S: list of Curve
# ---------- python: Python ----------
import rhinoscriptsyntax as rs
a = rs.AddSweep1(R,S, True)
# ---------- end python ----------
