# Grasshopper definition 5eae1039045b1950e5d8d90e80938c60660dd66f.ghx (Grasshopper 0.9.76)
# plug-ins: Python Interpreter

crv = Curve(graft([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]))

# ---- group: Concave Polygons
crv_2 = Curve([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])

# ---- group: Mixed Polygon
crv_3 = Curve([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])

# ---- group: Convex Polygons
crv_4 = Curve([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])

# ----
c_script = CSharpScript(polyline=crv)  # -> out, A, B, C; inputs polyline: Polyline
# ---------- c_script: C# ----------
    //Fit polyline points to plane results in incorrect plane orientation
    Plane plane0;
    Plane.FitPlaneToPoints(polyline, out plane0);


    //Mesh from closed polyline takes into account polyline orientation and results in good result
    Mesh mesh = Mesh.CreateFromClosedPolyline(polyline);

    //output
    A = polyline.CenterPoint();
    B = plane0.ZAxis * 100;
    C = mesh.FaceNormals[0] * 100;
# ---------- end c_script ----------
python = PythonScript(Polyline=graft([crv_3, crv_4, crv_2]))  # -> Planes, Center, DominantZAxis; inputs Polyline: Polyline
# ---------- python: Python ----------
import Rhino as rc
from collections import Counter

# Get consecutive vertex-center planes
Planes = []
Center = Polyline.CenterPoint()
for i in range(len(Polyline)-1):
    pl = rc.Geometry.Plane(Polyline[i],Polyline[i+1],Center)
    Planes.append(pl)

# Get dominant plane Z-axis direction
zAxis = [pl.ZAxis for pl in Planes]
DominantZAxis = Counter(zAxis).most_common(1)[0][0]
# ---------- end python ----------
vdis = VectorDisplay(Anchor=c_script.A, Vector=c_script.C)
vdis_2 = VectorDisplay(Anchor=c_script.A, Vector=c_script.B)

multiplication = Multiplication(A=python.DominantZAxis, B=Slider(100, range=0..100))
vdisex = VectorDisplayEx(Point=python.Center, Vector=multiplication, Colour=ColourSwatch(SwatchColor=RGB(255, 0, 0)), Width=2)

deplane = DeconstructPlane(Plane=python.Planes)  # -> Origin, XAxis, YAxis, ZAxis
multiplication_2 = Multiplication(A=deplane.ZAxis, B=Slider(81, range=0..100))
vdis_3 = VectorDisplay(Anchor=deplane.Origin, Vector=multiplication_2)
