# Grasshopper definition 60a7d75d83d9f5327e50ca6a3f931bdfeada3d4d.ghx (Grasshopper 0.9.80)

pt = Point([Point(4.997726928, 2.621844515, 15.20562573), Point(3.991026969, 2.632817497, 0), Point(2.127220227, 3.063291196, 7.042004954), Point(4.843332346, 9.772622413, 30), Point(4.54758092, 9.389673308, 10), Point(3.77231728, 5.233210076, 30)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])
pdecon = Deconstruct(Point=pt)  # -> XComponent, YComponent, ZComponent
round = Round(Number=pdecon.ZComponent)  # -> Nearest, Floor, Ceiling
equals = Equality(FirstNumber=round.Floor, SecondNumber=round.Ceiling)  # -> Equality, Inequality
cull = CullPattern(List=pdecon.ZComponent, CullPattern=equals.Equality)
cull_2 = CullPattern(List=pt, CullPattern=equals.Equality)
sort = SortList(Keys=cull, ValuesA=cull_2)  # -> Keys, ValuesA
cset = CreateSet(List=sort.Keys)  # -> Set, Map
lng = ListLength(List=cset.Set)
series = Series(Start=0, Step=1, Count=lng)
int = Integer(series)
mindex = MemberIndex(Set=cset.Map, Member=int)  # -> Index, Count
item = ListItem(List=sort.ValuesA, Index=mindex.Index, Wrap=True)
panel = Panel(item)
