# Grasshopper definition 694f1f83f6a22beb6a249e56d2f4e4ef8221a3a9.ghx (Grasshopper 1.0.7)

cir = Circle(Plane=PlaneXY(0, 0, 0), Radius=Slider(32.366, range=0..100))
bbox = BoundingBox(Content=cir, Plane=PlaneXY(0, 0, 0))  # -> Box, Box_2
rec = Rectangle(bbox.Box)
explode = Explode(Curve=rec, Recursive=True)  # -> Segments, Vertices
item = ListItem(List=explode.Segments, Index=0, Wrap=True)  # -> Item1, Item
eval = EvaluateLength(Curve=item.Item1, Length="0.5", Normalized=True)  # -> Point, Tangent, Parameter
eval_2 = EvaluateLength(Curve=item.Item, Length="0.5", Normalized=True)  # -> Point, Tangent, Parameter
shatter = Shatter(Curve=item.Item1, Parameters=eval.Parameter)
shatter_2 = Shatter(Curve=item.Item, Parameters=eval_2.Parameter)
item_2 = ListItem(List=shatter, Index=0, Wrap=True)  # -> Item, Item1
item_3 = ListItem(List=shatter_2, Index=0, Wrap=True)  # -> Item, Item1
flip = FlipCurve(Curve=item_2.Item)  # -> Curve, Flag
flip_2 = FlipCurve(Curve=item_3.Item)  # -> Curve, Flag
crv = Curve([flip_2.Curve, item_3.Item1])
crv_2 = Curve([flip.Curve, item_2.Item1])
divdist = DivideDistance(Curve=crv_2, Distance=Slider(5.779, range=0..20))  # -> flatten(Points), Tangents, Parameters
divdist_2 = DivideDistance(Curve=crv, Distance=Slider(6.129, range=0..20))  # -> flatten(Points), Tangents, Parameters
cullpt = CullDuplicates(Points=[divdist.Points, divdist_2.Points], Tolerance=0.01, CullMode=1)  # -> Points, Indices, Valence
srf_cp = SurfaceClosestPoint(Point=cullpt.Points, Surface=rec)  # -> Point, UVPoint, Distance
iso = IsoCurve(Surface=rec, UVPoint=srf_cp.UVPoint)  # -> UIsocurve, VIsocurve
srfsplit = SurfaceSplit(Surface=cir, Curves=flatten([iso.UIsocurve, iso.VIsocurve]))
