# Grasshopper definition 6b252377ab5dea966425fa95d93d020cb8c0c565.ghx (Grasshopper 1.0.7)

xy = XYPlane(Origin=Point(0, 0, 0))
rectangle = Rectangle(Plane=xy, XSize=Slider(25, range=0..25), YSize=Slider(25, range=0..100), Radius=0)  # -> Rectangle, Length
range = Range(Domain=Slider(25, range=0..25), Steps=Slider(2, range=0..10))
pt = ConstructPoint(XCoordinate=range, YCoordinate=graft(range), ZCoordinate="0")  # -> flatten(Point)
Z = UnitZ(Factor=Slider(16, range=0..16))
boxrec = BoxRectangle(Rectangle=rectangle.Rectangle, Height=Slider(0.5, range=0..1))
move = Move(Geometry=pt, Motion=Z)  # -> Geometry, Transform
dist = Distance(PointA=pt, PointB=graft(move.Geometry))
points = PointList(Points=pt, Size=2)
points_2 = PointList(Points=move.Geometry, Size=2)
smaller = SmallerThan(FirstNumber=dist, SecondNumber=Slider(21, range=0..100))  # -> SmallerThan, OrEqualTo
cull = CullPattern(List=move.Geometry, CullPattern=smaller.SmallerThan)
genes = GenePool(
    Decimals=3,
    Maximum=1,
    Minimum=0,
    Value=[0.8321090433, 0.6257837827, 0.2012004797, 0.2982985002, 0.6129285715, 0.3997042535, 0.992488971, 0.3756646208, 0.8295482205])
ln = Line(StartPoint=graft(pt), EndPoint=cull)
lng = ListLength(List=ln)  # -> expr("x-1", Length)
multiplication = Multiplication(A=flatten(lng), B=genes)
item = ListItem(List=ln, Index=graft(multiplication), Wrap=True)
pipe = Pipe(Curve=item, Radius=0.25, Caps=0)
