# Grasshopper definition 70f4f8c5dd23a64d64ccb2d2fac55e72bae21692.ghx (Grasshopper 1.0.7)

curve = Curve([<curve referenced from the Rhino model> x4])
curve_2 = Curve(<curve referenced from the Rhino model>)
curve_3 = Curve(<curve referenced from the Rhino model>)
loft = Loft(Curves=curve, Options={Adjust=False, Closed=False, LoftEnds=0, LoftSimp=0, LoftType=0, Rebuild=10, Refit=0.01})
end_points = EndPoints(Curve=curve_2)  # -> Start, End
end_points_2 = EndPoints(Curve=curve_3)  # -> Start, End
geodesic = Geodesic(Surface=loft, Start=end_points.Start, End=end_points_2.End)

# ---- group: ADDED MG
xy_plane = XYPlane(Origin=Point(0, 0, 0))

# ----
divide_curve = DivideCurve(Curve=geodesic, Count=Slider(15, range=0..100), Kinks=False)  # -> Points, Tangents, Parameters
center_box = CenterBox(Base=xy_plane, X="3", Y="3", Z="3")

# ---- group: ADDED MG
surface_closest_point = SurfaceClosestPoint(Point=divide_curve.Points, Surface=loft)  # -> Point, UVPoint, Distance

# ----
evaluate_surface = EvaluateSurface(Surface=loft, Point=surface_closest_point.UVPoint)  # -> Point, Normal, UDirection, VDirection, Frame

# ---- group: ADDED MG
orient = Orient(Geometry=center_box, Source=xy_plane, Target=evaluate_surface.Frame)  # -> Geometry, Transform

# ----
geometry = Geometry(orient.Geometry)
