# Grasshopper definition 728507eb7c3357a0260a7f41292a1dc2a3007330.ghx (Grasshopper 1.0.7)

shapes = Brep([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])
mjoin = MeshJoin(Meshes=shapes)

# ---- group: Mesh points at z=0
demesh = DeconstructMesh(Mesh=mjoin)  # -> Vertices, Faces, Colours, Normals
pdecon = Deconstruct(Point=demesh.Vertices)  # -> XComponent, YComponent, ZComponent
similar = Similarity(FirstNumber=pdecon.ZComponent, SecondNumber=0, Threshold=0.01)  # -> Similarity, AbsoluteDifference
cull = CullPattern(List=demesh.Vertices, CullPattern=similar.Similarity)

# ---- group: Volume Centroid
volume = Volume(Geometry=mjoin)  # -> Volume, Centroid

# ----
project = Project(Geometry=volume.Centroid, Plane=PlaneXY(0, 0, 0))  # -> Geometry, Transform
hull = ConvexHull(Points=cull, Plane=PlaneXY(0, 0, 0))  # -> Hull, HullZ, Indices
panel = Panel("""Unstable
Stable""")
incurve = PointInCurve(Point=project.Geometry, Curve=hull.HullZ)  # -> expr("Min(x, 1)", Relationship), Point
item = ListItem(List=panel, Index=incurve.Relationship, Wrap=True)
panel_2 = Panel(item)
