# Grasshopper definition 779f720f5af81f82d867f32905101a02dce883f3.ghx (Grasshopper 1.0.7)
# plug-ins: Pufferfish

crv_profile = Curve(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)
crv_rail_1 = Curve(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)
crv_rail_2 = Curve(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)
crv_guia = Curve(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)
number_slider = Slider(79, range=0..360)  # disabled

curvepoint = PointOnCurve(crv_rail_1, parameter=0)
curvepoint_2 = PointOnCurve(crv_rail_2, parameter=0)
curvepoint_3 = PointOnCurve(crv_guia, parameter=0)

crv = Curve(crv_profile)  # disabled
number_slider_2 = Slider(15, range=0..15)
pt = Point([Point(358.1118478, -0.1980831438, 0), Point(285.0001842, -0.2005669959, 0), Point(321.5441193, 22.37329991, 0), Point(321.5441193, 0, 0)])
number_slider_3 = Slider(90, range=0..360)  # disabled
area = Area(Geometry=crv)  # -> Area, Centroid; disabled
item = ListItem(List=pt, Index=0, Wrap=True)  # -> Item, Item1, Item2, Item3
divide = DivideCurve(Curve=crv_guia, Count=expr("x-1", number_slider_2), Kinks=False)  # -> graft(Points), Tangents, Parameters
pull = PullPoint(Point=divide.Points, Geometry=crv_rail_1, ClosestOnly=True)  # -> ClosestPoint, Distance
pull_2 = PullPoint(Point=divide.Points, Geometry=crv_rail_2, ClosestOnly=True)  # -> ClosestPoint, Distance
panel = Panel("-1")  # disabled
pframes = PerpFrames(Curve=reparameterize(crv_rail_1), Count=number_slider, Align=True)  # -> Frames, Parameters; disabled
Z = UnitZ(Factor=panel)  # disabled
prot = RotatePlane(Plane=area.Centroid, Angle=degrees(number_slider_3))  # disabled
dist = Distance(PointA=pull.ClosestPoint, PointB=pull_2.ClosestPoint)
align = AlignPlane(Plane=pframes.Frames, Direction=Z)  # -> Plane, Angle; disabled
dist_2 = Distance(PointA=item.Item, PointB=item.Item1)
division = Division(A=dist, B=dist_2)
orient = Orient(Geometry=crv, Source=prot, Target=align.Plane)  # -> flatten(Geometry), Transform; disabled
scale_nu = ScaleNU(Geometry=crv_profile, Plane=item.Item3, ScaleX=division, ScaleY=1, ScaleZ=1)  # -> Geometry, Transform
loft = Loft(Curves=orient.Geometry, Options={Adjust=False, Closed=False, LoftEnds=0, LoftSimp=0, LoftType=0, Rebuild=10, Refit=0.01})  # disabled
md_slider = MDSlider(SliderMode=0, slider_value=Point(0.5, 0.5, 0.5), x_domain=Domain(0, 1), y_domain=Domain(0, 1), z_domain=Domain(0, 1))
evalsrf = EvaluateSurface(Surface=reparameterize(scale_nu.Geometry), Point=md_slider)  # -> Point, Normal, UDirection, VDirection, Frame
disc = Discontinuity(Curve=scale_nu.Geometry, Level=1)  # -> Points, Parameters
pl = PlaneNormal(Origin=evalsrf.Point, ZAxis=evalsrf.VDirection)
item_2 = ListItem(List=disc.Points, Index=0, Wrap=True)  # -> Item, Item1
x_tremez = Extremes(Curve=scale_nu.Geometry, Plane=pl)  # -> Highest, Lowest
entwine = Entwine(Branch00=item_2.Item, Branch01=item_2.Item1, Branch02=x_tremez.Lowest, FlattenInputs=True)
flip = FlipMatrix(Data=entwine)
item_3 = ListItem(List=flip, Index=0, Wrap=True)  # -> Item, Item1, Item2
merge = Merge(Data1=divide.Points, Data2=pull.ClosestPoint, Data3=pull_2.ClosestPoint)
pline = PolyLine(Vertices=[item_3.Item, item_3.Item1, item_3.Item2], Closed=invert(False))
item_4 = ListItem(List=merge, Index=0, Wrap=True)  # -> Item, Item1, Item2
pline_2 = PolyLine(Vertices=[item_4.Item1, item_4.Item2, item_4.Item], Closed=invert(False))
flip_2 = FlipMatrix(Data=pline_2)
pcen = PolygonCenter(Polyline=flip_2)  # -> CenterV, CenterE, CenterA
trimap = TriangleMapping(Geometry=scale_nu.Geometry, Source=pline, Target=pline_2)  # -> Geometry, Transform
pshift = ShiftPaths(Data=trimap.Geometry, Offset=-1)
intcrv = Interpolate(Vertices=pcen.CenterA, Degree=3, Periodic=False, KnotStyle=1)  # -> reparameterize(Curve), Length, Domain
nurbs = NurbsCurve(Vertices=pcen.CenterA, Degree=3, Periodic=False)  # -> Curve, Length, Domain

# ----
# ADDITIONAL CURVE TWEENING
number_slider_4 = Slider(1, range=0..1)
dom = ConstructDomain(DomainStart=Slider(0, range=0..1), DomainEnd=number_slider_4)
addition = Addition(A=number_slider_2, B=Slider(20, range=0..100))
range = Range(Domain=dom, Steps=expr("x-1", addition))
graph = GraphMapper(range, x0=0, x1=1, y0=0, y1=1, Gx=0.6983162761, Gy=0.5528553724, container_name="Power", power=1.650477962)
eval = EvaluateLength(Curve=intcrv.Curve, Length=graph, Normalized=True)  # -> Point, Tangent, Parameter
twnthrucrvs = TweenThroughCurves(
    Curves=pshift,
    Factor=eval.Parameter,
    Normalized=invert(False),
    InterpolationType=Slider(2, range=0..3),
    Refit=0,
    PointSample=0)
