# Grasshopper definition 77d5c08b3b5d41a79787b887ee3fb2beb25d0852.ghx (Grasshopper 1.0.7)
# plug-ins: MeshEdit Components, Weaverbird, Kangaroo2 Components

number_slider = Slider(50, range=0..100)

number_slider_2 = Slider(20, range=0..100)  # disabled
pi = Pi(Factor=2)  # disabled
number_slider_3 = Slider(3, range=0..10)  # disabled
range = Range(Domain=pi, Steps=number_slider_2)  # disabled
number_slider_4 = Slider(14, range=0..100)  # disabled
sin = Sine(Value=range)  # disabled
cos = Cosine(Value=range)  # disabled
pow = Power(A=sin, B=number_slider_3)  # disabled
multiplication = Multiplication(A=pow, B=number_slider_4)  # disabled
multiplication_2 = Multiplication(A=cos, B=number_slider_4)  # disabled
pt = ConstructPoint(XCoordinate=multiplication_2, YCoordinate=multiplication, ZCoordinate=0)  # disabled
vec = VectorXYZ(XComponent=number_slider_4, YComponent=0, ZComponent=0)  # -> Vector, Length; disabled
intcrv = Interpolate(Vertices=pt, Degree=3, Periodic=False, KnotStyle=1)  # -> Curve, Length, Domain; disabled
number_slider_5 = Slider(12, range=0..100)  # disabled
move = Move(Geometry=intcrv.Curve, Motion=vec.Vector)  # -> Geometry, Transform; disabled
arrpolar = PolarArray(Geometry=move.Geometry, Plane=PlaneXY(0, 0, 0), Count=number_slider_5, Angle=6.283185307)  # -> Geometry, Transform; disabled

circle = CircleCNR(Center=Point(0, 0, 0), Normal=Vector(0, 0, 1), Radius=number_slider)
vec_2 = VectorXYZ(XComponent=0, YComponent=number_slider, ZComponent=0)  # -> Vector, Length
move_2 = Move(Geometry=circle, Motion=vec_2.Vector)  # -> Geometry, Transform
multiplication_3 = Multiplication(A=number_slider, B=2)
arrpolar_2 = PolarArray(Geometry=move_2.Geometry, Plane=PlaneXY(0, 0, 0), Count=Slider(20, range=0..100), Angle=6.283185307)  # -> Geometry, Transform
circle_2 = CircleCNR(Center=Point(0, 0, 0), Normal=Vector(0, 0, 1), Radius=multiplication_3)
srfsplit = SurfaceSplit(Surface=circle_2, Curves=arrpolar_2.Geometry)

area = Area(Geometry=srfsplit)  # -> Area, Centroid
sort = SortList(Keys=area.Area)  # -> Keys, ValuesA
lng = ListLength(List=sort.Keys)
subtraction = Subtraction(A=lng, B=1)
item = ListItem(List=sort.Keys, Index=0, Wrap=True)
item_2 = ListItem(List=sort.Keys, Index=subtraction, Wrap=True)
dom = ConstructDomain(DomainStart=Slider(0.5, range=0..10), DomainEnd=Slider(8, range=0..50))
dom_2 = ConstructDomain(DomainStart=item, DomainEnd=item_2)
remap = RemapNumbers(Value=area.Area, Source=dom_2, Target=dom)  # -> Mapped, Clipped
vec_3 = VectorXYZ(XComponent=0, YComponent=0, ZComponent=remap.Mapped)  # -> Vector, Length
move_3 = Move(Geometry=area.Centroid, Motion=vec_3.Vector)  # -> Geometry, Transform

crv = Curve(srfsplit)
item_3 = ListItem(List=crv, Index=0, Wrap=True)
flip = FlipCurve(Curve=crv, Guide=item_3)  # -> Curve, Flag
custom_mesh_settings = SettingsCustom(
    StitchSeams=True,
    SimplePlanes=Toggle(False),
    Refine=Toggle(True),
    MinCount=16,
    MaxCount=400,
    AspectRatio=20,
    MaxDistance=0,
    MaxAngle=20,
    MinEdge=Slider(0.5, range=0..10),
    MaxEdge=Slider(4, range=0..10))
flip_2 = FlipCurve(Curve=flip.Curve)  # -> Curve, Flag
extr = ExtrudePoint(Base=flip_2.Curve, Point=move_3.Geometry)
mesh = MeshBrep(Brep=extr, Settings=custom_mesh_settings)
clean = CombineClean(Meshes=mesh)
weldvertices = MeshWeldVertices(Mesh=clean, Tolerance=0.01)  # -> RuntimeMessage, Mesh
wblaplace = WeaverbirdsLaplacianSmoothing(MeshCurves=weldvertices.Mesh, Level=Slider(8, range=0..10), SmoothNakedEdges="0", Thin=1)  # -> flatten(OutputMeshCurves)
preview = CustomPreview(Geometry=wblaplace, Material=ColourSwatch(SwatchColor=RGB(186, 147, 147)))
