# Grasshopper definition 7c0c9533412127cc4cd871cd8520d63fcf0ee0fa.ghx (Grasshopper 1.0.7)

flat_foil_data = Panel("""0,0
402,12
804,46
1206,116
1608,227
1976,364
2344,542
2711,765
3038,1046
3272,1320
3286,1788""")  # disabled
canopy_angle = Panel("""7
18
32
45
56
68
79
85
90
150""")  # disabled
chord_length = Panel("""1665
1606
1510
1393
1231
1024
740
468""")  # disabled
le_diameter = Panel("""131
130
128
120
113
105
100
100
65""")  # disabled
cluster = Cluster()
combine = CombineData(Input0=canopy_angle)  # -> Result, Index; disabled
combine_2 = CombineData(Input0=flat_foil_data)  # -> Result, Index; disabled
panel = Panel(combine_2.Result)  # disabled
flat_foil_data_2 = Panel("""0,0
402,12
804,46
1206,116
1608,227
1976,364
2344,542
2711,765
3038,1046
3272,1320
3286,1788""")

# ---- group: Lines Plotted
panel_2 = Panel("2")  # disabled
panel_3 = Panel("4")  # disabled
panel_4 = Panel("8")  # disabled
panel_5 = Panel("0")  # disabled
panel_6 = Panel("1")  # disabled
panel_7 = Panel("3")  # disabled
panel_8 = Panel("5")  # disabled
panel_9 = Panel("6")  # disabled
panel_10 = Panel("7")  # disabled
panel_11 = Panel("9")  # disabled
item = ListItem(List=combine_2.Result, Index=panel_6, Wrap=True)  # disabled
item_2 = ListItem(List=combine_2.Result, Index=panel_2, Wrap=True)  # disabled
item_3 = ListItem(List=combine_2.Result, Index=panel_7, Wrap=True)  # disabled
item_4 = ListItem(List=combine_2.Result, Index=panel_3, Wrap=True)  # disabled
item_5 = ListItem(List=combine_2.Result, Index=panel_8, Wrap=True)  # disabled
item_6 = ListItem(List=combine_2.Result, Index=panel_9, Wrap=True)  # disabled
item_7 = ListItem(List=combine_2.Result, Index=panel_10, Wrap=True)  # disabled
item_8 = ListItem(List=combine_2.Result, Index=panel_4, Wrap=True)  # disabled
item_9 = ListItem(List=combine_2.Result, Index=panel_11, Wrap=True)  # disabled
item_10 = ListItem(List=combine_2.Result, Index=panel_5, Wrap=True)  # disabled
pt = Point(item_10)  # disabled
pt_2 = Point(item)  # disabled
pt_3 = Point(item_2)  # disabled
pt_4 = Point(item_3)  # disabled
pt_5 = Point(item_4)  # disabled
pt_6 = Point(item_5)  # disabled
pt_7 = Point(item_8)  # disabled
pt_8 = Point(item_9)  # disabled
pt_9 = Point(item_7)  # disabled
pt_10 = Point(item_6)  # disabled

# ---- group: Rotations
panel_12 = Panel("0")  # disabled
panel_13 = Panel("2")  # disabled
panel_14 = Panel("3")  # disabled
panel_15 = Panel("7")  # disabled
panel_16 = Panel("1")  # disabled
panel_17 = Panel("4")  # disabled
panel_18 = Panel("5")  # disabled
panel_19 = Panel("6")  # disabled
item_11 = ListItem(List=combine.Result, Index=panel_12, Wrap=True)  # disabled
item_12 = ListItem(List=combine.Result, Index=panel_16, Wrap=True)  # disabled
item_13 = ListItem(List=combine.Result, Index=panel_13, Wrap=True)  # disabled
item_14 = ListItem(List=combine.Result, Index=panel_14, Wrap=True)  # disabled
item_15 = ListItem(List=combine.Result, Index=panel_17, Wrap=True)  # disabled
item_16 = ListItem(List=combine.Result, Index=panel_18, Wrap=True)  # disabled
item_17 = ListItem(List=combine.Result, Index=panel_19, Wrap=True)  # disabled
item_18 = ListItem(List=combine.Result, Index=panel_15, Wrap=True)  # disabled
rad = Radians(Degrees=item_11)  # disabled
rad_2 = Radians(Degrees=item_12)  # disabled
rad_3 = Radians(Degrees=item_13)  # disabled
rad_4 = Radians(Degrees=item_14)  # disabled
rad_5 = Radians(Degrees=item_15)  # disabled
rad_6 = Radians(Degrees=item_16)  # disabled
rad_7 = Radians(Degrees=item_17)  # disabled
rad_8 = Radians(Degrees=item_18)  # disabled

# ----
split = TextSplit(Text=flat_foil_data_2, Separators=",")
item_19 = ListItem(List=split, Index=0, Wrap=True)  # -> Item, Item1
canopy_angle_2 = Panel("""7
18
32
45
56
68
79
85
90
150""")
pt_11 = ConstructPoint(XCoordinate=item_19.Item, YCoordinate=item_19.Item1, ZCoordinate=0)  # -> flatten(Point)
pline = PolyLine(Vertices=pt_11, Closed=False)
rad_9 = Radians(Degrees=canopy_angle_2)

ln = Line(StartPoint=pt, EndPoint=pt_2)  # disabled
ln_2 = Line(StartPoint=pt_2, EndPoint=pt_3)  # disabled
ln_3 = Line(StartPoint=pt_3, EndPoint=pt_4)  # disabled
ln_4 = Line(StartPoint=pt_4, EndPoint=pt_5)  # disabled
ln_5 = Line(StartPoint=pt_5, EndPoint=pt_6)  # disabled
ln_6 = Line(StartPoint=pt_6, EndPoint=pt_10)  # disabled
ln_7 = Line(StartPoint=pt_10, EndPoint=pt_9)  # disabled
ln_8 = Line(StartPoint=pt_9, EndPoint=pt_7)  # disabled

explode = Explode(Curve=pline, Recursive=True)  # -> Segments, Vertices
pt_12 = Point(item_8)  # disabled
pt_13 = Point(item_9)  # disabled
end = EndPoints(Curve=explode.Segments)  # -> Start, End
Y = UnitY(Factor=1)
rot3d = Rotate3D(Geometry=explode.Segments, Angle=rad_9, Center=end.Start, Axis=Y)  # -> Geometry, Transform
toggle = BooleanToggle(False)
neg = Negative(Value="1")
shift = ShiftList(List=rot3d.Geometry, Shift=neg, Wrap=toggle)
shift_2 = ShiftList(List=rot3d.Geometry, Shift="1", Wrap=toggle)
end_2 = EndPoints(Curve=shift)  # -> Start, End
end_3 = EndPoints(Curve=shift_2)  # -> Start, End
vec2pt = Vector2Pt(PointA=end_3.Start, PointB=end_2.End, Unitize=False)  # -> Vector, Length
ma = MassAddition(Input=vec2pt.Vector)  # -> Result, PartialResults
move = Move(Geometry=shift_2, Motion=ma.PartialResults)  # -> flatten(Geometry), Transform
item_20 = ListItem(List=rot3d.Geometry, Index=0, Wrap=True)  # -> flatten(Item)
Y_2 = UnitY(Factor=1)  # disabled
Y_3 = UnitY(Factor=1)  # disabled
Y_4 = UnitY(Factor=1)  # disabled
Y_5 = UnitY(Factor=1)  # disabled
Y_6 = UnitY(Factor=1)  # disabled
Y_7 = UnitY(Factor=1)  # disabled
Y_8 = UnitY(Factor=1)  # disabled
Y_9 = UnitY(Factor=1)  # disabled
merge = Merge(Data1=item_20, Data2=move.Geometry)
rot3d_2 = Rotate3D(Geometry=ln, Angle=rad, Center=pt, Axis=Y_3)  # -> Geometry, Transform; disabled
rot3d_3 = Rotate3D(Geometry=ln_2, Angle=rad_2, Center=pt_2, Axis=Y_9)  # -> Geometry, Transform; disabled
rot3d_4 = Rotate3D(Geometry=ln_3, Angle=rad_3, Center=pt_3, Axis=Y_4)  # -> Geometry, Transform; disabled
rot3d_5 = Rotate3D(Geometry=ln_4, Angle=rad_4, Center=pt_4, Axis=Y_2)  # -> Geometry, Transform; disabled
rot3d_6 = Rotate3D(Geometry=ln_5, Angle=rad_5, Center=pt_6, Axis=Y_5)  # -> Geometry, Transform; disabled
rot3d_7 = Rotate3D(Geometry=ln_6, Angle=rad_6, Center=pt_10, Axis=Y_6)  # -> Geometry, Transform; disabled
rot3d_8 = Rotate3D(Geometry=ln_7, Angle=rad_7, Center=pt_9, Axis=Y_7)  # -> Geometry, Transform; disabled
rot3d_9 = Rotate3D(Geometry=ln_8, Angle=rad_8, Center=pt_7, Axis=Y_8)  # -> Geometry, Transform; disabled
join = JoinCurves(Curves=merge, Preserve=False)
end_4 = EndPoints(Curve=rot3d_2.Geometry)  # -> Start, End; disabled
end_5 = EndPoints(Curve=rot3d_3.Geometry)  # -> Start, End; disabled
end_6 = EndPoints(Curve=rot3d_4.Geometry)  # -> Start, End; disabled
end_7 = EndPoints(Curve=rot3d_5.Geometry)  # -> Start, End; disabled
end_8 = EndPoints(Curve=rot3d_6.Geometry)  # -> Start, End; disabled
end_9 = EndPoints(Curve=rot3d_7.Geometry)  # -> Start, End; disabled
end_10 = EndPoints(Curve=rot3d_8.Geometry)  # -> Start, End; disabled
end_11 = EndPoints(Curve=rot3d_9.Geometry)  # -> Start, End; disabled
vec2pt_2 = Vector2Pt(PointA=end_5.Start, PointB=end_4.End, Unitize=False)  # -> Vector, Length; disabled
move_2 = Move(Geometry=rot3d_3.Geometry, Motion=vec2pt_2.Vector)  # -> Geometry, Transform; disabled

end_12 = EndPoints(Curve=move_2.Geometry)  # -> Start, End; disabled

vec2pt_3 = Vector2Pt(PointA=end_6.Start, PointB=end_12.End, Unitize=False)  # -> Vector, Length; disabled
move_3 = Move(Geometry=rot3d_4.Geometry, Motion=vec2pt_3.Vector)  # -> Geometry, Transform; disabled

end_13 = EndPoints(Curve=move_3.Geometry)  # -> Start, End; disabled

vec2pt_4 = Vector2Pt(PointA=end_7.Start, PointB=end_13.End, Unitize=False)  # -> Vector, Length; disabled
move_4 = Move(Geometry=rot3d_5.Geometry, Motion=vec2pt_4.Vector)  # -> Geometry, Transform; disabled

end_14 = EndPoints(Curve=move_4.Geometry)  # -> Start, End; disabled

vec2pt_5 = Vector2Pt(PointA=end_8.Start, PointB=end_14.End, Unitize=False)  # -> Vector, Length; disabled
move_5 = Move(Geometry=rot3d_6.Geometry, Motion=vec2pt_5.Vector)  # -> Geometry, Transform; disabled

end_15 = EndPoints(Curve=move_5.Geometry)  # -> Start, End; disabled

vec2pt_6 = Vector2Pt(PointA=end_9.Start, PointB=end_15.End, Unitize=False)  # -> Vector, Length; disabled
move_6 = Move(Geometry=rot3d_7.Geometry, Motion=vec2pt_6.Vector)  # -> Geometry, Transform; disabled

end_16 = EndPoints(Curve=move_6.Geometry)  # -> Start, End; disabled

vec2pt_7 = Vector2Pt(PointA=end_10.Start, PointB=end_16.End, Unitize=False)  # -> Vector, Length; disabled
move_7 = Move(Geometry=rot3d_8.Geometry, Motion=vec2pt_7.Vector)  # -> Geometry, Transform; disabled

end_17 = EndPoints(Curve=move_7.Geometry)  # -> Start, End; disabled

vec2pt_8 = Vector2Pt(PointA=end_11.Start, PointB=end_17.End, Unitize=False)  # -> Vector, Length; disabled
move_8 = Move(Geometry=rot3d_9.Geometry, Motion=vec2pt_8.Vector)  # -> Geometry, Transform; disabled

end_18 = EndPoints(Curve=move_8.Geometry)  # -> Start, End; disabled

# ==== cluster Cluster
