# Grasshopper definition 8755234d07329d114693474a1da2db2ad23e7f8a.ghx (Grasshopper 1.0.7)

crv = Curve(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)
debrep = DeconstructBrep(Brep=crv)  # -> Faces, Edges, Vertices
boundary = BoundarySurfaces(Edges=crv)
item = ListItem(List=debrep.Vertices, Index=Slider(1, range=0..6), Wrap=True)
xz = XZPlane(Origin=item)
sqgrid = Square(Plane=xz, Size=Slider(5000, range=0..10000), ExtentX="10", ExtentY="14")  # -> Cells, Points
area = Area(Geometry=sqgrid.Cells)  # -> Area, Centroid
colom = CollisionOneMany(Collider=area.Centroid, Obstacles=boundary)  # -> Collision, Index
cull = CullPattern(List=area.Centroid, CullPattern=colom.Collision)
pt = Point([Point(-19154.01471, 49751.53595, 19359.92098), Point(-17661.21885, 39867.60971, 19094.75502), Point(-16497.50913, 29939.55254, 18829.59074), Point(-15665.22992, 19978.2474, 18564.42678)])
graft = GraftTree(Tree=cull, IncludeEmptyLists=True, IncludeNullItems=True)
ins = InsertItems(List=pt, Item=graft, Indices="-1", Wrap=True)
intcrv = Interpolate(Vertices=ins, Degree=3, Periodic=False, KnotStyle=1)  # -> Curve, Length, Domain
