# Grasshopper definition 8bdc792d38874018c17c73ed160da8812803d872.ghx (Grasshopper 1.0.7)

outer_diameter = Slider(150, range=0..1000)
helix_points = Slider(90, range=0..100)
inner_diameter = Slider(1, range=0..1000)
circle_dia = Slider(15.875, range=0..25.4)
crossover = Slider(0.1, range=0..1)
mesh = Mesh(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)
area = Area(Geometry=mesh)  # -> Area, Centroid
pdecon = Deconstruct(Point=area.Centroid)  # -> XComponent, YComponent, ZComponent
multiplication = Multiplication(A=pdecon.XComponent, B=-1)
vec = VectorXYZ(XComponent=multiplication, YComponent=multiplication, ZComponent=0)  # -> Vector, Length
move = Move(Geometry=mesh, Motion=vec.Vector)  # -> Geometry, Transform
xy = XYPlane(Origin=Point(0, 0, 0))

# ---- group: Mesh Deconstruct
construct_point = ConstructPoint(XCoordinate=0, YCoordinate=0, ZCoordinate=0)
move_2 = Move(Geometry=move.Geometry, Motion=construct_point)  # -> Geometry, Transform
deconstruct_mesh = DeconstructMesh(Mesh=move_2.Geometry)  # -> Vertices, Faces, Colours, Normals
deconstruct = Deconstruct(Point=deconstruct_mesh.Vertices)  # -> XComponent, YComponent, ZComponent
z_values = Panel(deconstruct.ZComponent)
sort = SortList(Keys=z_values)  # -> Keys, ValuesA
lng = ListLength(List=z_values)
sorted_least_to_greatest = Panel(sort.Keys)
subtraction = Subtraction(A=lng, B=1)
model_height = ListItem(List=sorted_least_to_greatest, Index=subtraction, Wrap=True)
model_height_2 = Panel(model_height)

# ----
sec = MeshPlane(Mesh=move.Geometry, Plane=xy)
line = LineSDL(Start=xy, Direction=Vector(0, 0, 1), Length=1)
xz = XZPlane(Origin=Point(0, 0, 0))
eval = EvaluateLength(Curve=sec, Length=Slider(0.5, range=0..1), Normalized=True)  # -> Point, Tangent, Parameter
pframe = PerpFrame(Curve=sec, Parameter=eval.Parameter)
sec_2 = MeshPlane(Mesh=move.Geometry, Plane=pframe)
pcx = CurvePlane(Curve=sec_2, Plane=xz)  # -> Points, ParamsC, ParamsP
shatter = Shatter(Curve=sec_2, Parameters=pcx.ParamsC)
item = ListItem(List=shatter, Index=0, Wrap=True)
revsrf = Revolution(Curve=item, Axis=line, Domain=Domain(0, 6.283185307))

# ---- group: Inner|Outer Helix / Axis Spiral
multiplication_2 = Multiplication(A=circle_dia, B=crossover)
addition = Addition(A=model_height_2, B=-1)
division = Division(A=addition, B=multiplication_2)
round = Round(Number=division)  # -> Nearest, Floor, Ceiling
multiplication_3 = Multiplication(A=helix_points, B=round.Ceiling)
expression = Expression(x=multiplication_3, y=round.Ceiling, Expression="y*2*pi/x")
series = Series(Start=0, Step=expression, Count=expr("x+1", multiplication_3))
sin = Sine(Value=series)
cos = Cosine(Value=series)
multiplication_4 = Multiplication(A=multiplication_2, B=round.Ceiling)
bnd = Bounds(Numbers=series)
rev = ReverseList(List=series)
multiplication_5 = Multiplication(A=sin, B=inner_diameter)
multiplication_6 = Multiplication(A=cos, B=inner_diameter)
remap = RemapNumbers(Value=rev, Source=bnd, Target=multiplication_4)  # -> Mapped, Clipped
pt = ConstructPoint(XCoordinate=multiplication_5, YCoordinate=multiplication_6, ZCoordinate=remap.Mapped)

# ---- group: Inner|Outer Helix / Outer Helix
addition_2 = Addition(A=model_height_2, B=-1)
multiplication_7 = Multiplication(A=circle_dia, B=crossover)
division_2 = Division(A=addition_2, B=multiplication_7)
multiplication_8 = Multiplication(A=helix_points, B=division_2)
expression_2 = Expression(x=multiplication_8, y=division_2, Expression="y*2*pi/x")
series_2 = Series(Start=0, Step=expression_2, Count=expr("x+1", multiplication_8))
rev_2 = ReverseList(List=series_2)
rev_3 = ReverseList(List=rev_2)
bnd_2 = Bounds(Numbers=rev_3)
rev_4 = ReverseList(List=bnd_2)
sin_2 = Sine(Value=rev_3)
cos_2 = Cosine(Value=rev_3)
rev_5 = ReverseList(List=rev_3)
multiplication_9 = Multiplication(A=multiplication_7, B=division_2)
multiplication_10 = Multiplication(A=sin_2, B=outer_diameter)
multiplication_11 = Multiplication(A=cos_2, B=outer_diameter)
remap_2 = RemapNumbers(Value=rev_5, Source=rev_4, Target=multiplication_9)  # -> Mapped, Clipped
pt_2 = ConstructPoint(XCoordinate=multiplication_10, YCoordinate=multiplication_11, ZCoordinate=remap_2.Mapped)

# ----
ln = Line(StartPoint=pt_2, EndPoint=pt)
mcx = MeshCurve(Mesh=move.Geometry, Curve=ln)  # -> Points, Faces
pshift = ShiftPaths(Data=mcx.Points, Offset=-1)
brep_cp = BrepClosestPoint(Point=pshift, Brep=revsrf)  # -> Point, Normal, Distance
cullpt = CullDuplicates(Points=brep_cp.Point, Tolerance=0.1, CullMode=1)  # -> Points, Indices, Valence
line_2 = LineSDL(Start=brep_cp.Point, Direction=brep_cp.Normal, Length=1)
end = EndPoints(Curve=line_2)  # -> Start, End
intcrv = Interpolate(Vertices=end.End, Degree=3, Periodic=False, KnotStyle=1)  # -> Curve, Length, Domain
len = Length(Curve=intcrv.Curve)
multiplication_12 = Multiplication(A=len, B=Slider(0.006615, range=0..1))
neg = Negative(Value=multiplication_12)
ext = ExtendCurve(Curve=intcrv.Curve, Type=0, Start=Slider(0, range=0..1), End=neg)
pipe = Pipe(Curve=ext, Radius=1, Caps=0)
