# Grasshopper definition 8d75d7e76d069f848aa005ef98cab952c5c679cd.ghx (Grasshopper 1.0.7)
# plug-ins: Pufferfish

genes = GenePool(Decimals=5, Maximum=18, Minimum=17, Value=17.39615)
crv = Curve(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)
number_slider = Slider(2844, range=0..10000)
offset = OffsetCurve(Curve=crv, Distance=expr("-X", genes), Plane=PlaneXY(0, 0, 0), Corners=1)
area = Area(Geometry=crv)  # -> Area, Centroid
area_2 = Area(Geometry=offset)  # -> Area, Centroid
panel = Panel(area.Area)
panel_2 = Panel(area_2.Area)
expression = Expression(x=area_2.Area, y=number_slider, Expression="sqrt((x-y)²)")
scale2area = ScaleToArea(Geometry=crv, Plane=area.Centroid, Area=number_slider, FactorX=1, FactorY=1, FactorZ=1)  # -> Scaled, Transform
area_3 = Area(Geometry=scale2area.Scaled)  # -> Area, Centroid
galapagos = Galapagos(fitness=expression, gene=genes)
panel_3 = Panel(expression)
panel_4 = Panel(area_3.Area)
