# Grasshopper definition 8fd8d730951771593dc6f9355aa77efcda7cb3e7.ghx (Grasshopper 0.9.76)

number_slider = Slider(22, range=0..50)
recgrid = Rectangular(Plane=PlaneXY(0, 0, 0), SizeX=1, SizeY=2, ExtentX=10, ExtentY=5)  # -> flatten(Cells), Points
item = ListItem(List=recgrid.Cells, Index=number_slider, Wrap=True)
cull_i = CullIndex(List=recgrid.Cells, Indices=number_slider, Wrap=True)
ccx = CurveCurve(CurveA=item, CurveB=graft(cull_i))  # -> Points, ParamsA, ParamsB
boundary = BoundarySurfaces(Edges=item)
preview = CustomPreview(
    Geometry=boundary,
    Shader={ambient=RGB(0, 0, 0), diffuse=RGB(255, 105, 180), emission=RGB(76, 32, 54), shine=0.5, specular=RGB(255, 255, 255), transparency=0})
tstat = TreeStatistics(Tree=ccx.Points)  # -> Paths, Length, Count
equals = Equality(FirstNumber=tstat.Length, SecondNumber="0")  # -> Equality, Inequality
cull = CullPattern(List=cull_i, CullPattern=equals.Inequality)
boundary_2 = BoundarySurfaces(Edges=cull)
