# Grasshopper definition a2a5278b2828240e07da3e6fe6211615deedf105.ghx (Grasshopper 1.0.4)

curve = Curve(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)
control_points = ControlPoints(Curve=curve)  # -> Points, Weights, Knots
panel = Panel("""0
5
4
3
0""")
unit_z = UnitZ(Factor=panel)
point_deform = PointDeform(Geometry=curve, Points=control_points.Points, Motion=unit_z)
control_points_2 = ControlPoints(Curve=point_deform)  # -> Points, Weights, Knots
