# Grasshopper definition b9e0084d8296d3b2839e972791c4b97550d14c1d.ghx (Grasshopper 1.0.7)

crv = Curve([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])
Z = UnitZ(Factor=Slider(10, range=0..100))
extr = Extrude(Base=crv, Direction=Z)
edgescvx = ConvexEdges(Brep=extr)  # -> Convex, Concave, Mixed
filedge = FilletEdge(Shape=graft(extr), Blend=1, Metric=1, Edges=edgescvx.Convex, Radii=Slider(5, range=0..8))
edges = BrepEdges(Brep=filedge)  # -> Naked, Interior, NonManifold
eval = EvaluateLength(Curve=edges.Naked, Length="0.5", Normalized=True)  # -> Point, Tangent, Parameter
pdecon = Deconstruct(Point=eval.Point)  # -> XComponent, YComponent, ZComponent
sort = SortList(Keys=pdecon.ZComponent, ValuesA=edges.Naked)  # -> Keys, ValuesA
subset = SubList(List=sort.ValuesA, Domain="2", Wrap=True)  # -> List, Index
join = JoinCurves(Curves=subset.List, Preserve=False)  # -> flatten(Curves)
connect = ConnectCurves(Curves=join, Continuity=0, Close=True, Bulge=1)
boundary = BoundarySurfaces(Edges=connect)
