# Grasshopper definition ba2a204ca62120f960d371254b72fb07cd008387.ghx (Grasshopper 1.0.7)
# plug-ins: Human UI

label = CreateLabel(LabelText="Text Box", LabelSize=12, Justification=0)
textbox = CreateTextBox(UpdateButton=True, showLabel=False)
merge = Merge(Data1=label, Data2=textbox)
panel = Panel("""0
1""")
panel_2 = Panel("""Auto
*""")
toggle = CreateToggle(Default=False)

# ---- group: Set Property
panel_3 = Panel(""" <FontFamily>
                    <FontFamily.FamilyMaps>
                        <FontFamilyMap Target="Comic Sans MS"/>
                    </FontFamily.FamilyMaps>

                </FontFamily>""")
xaml = CreateObjectsFromXAML(XAML=panel_3)
setprop = SetElementProperty(UIElement=[label, toggle], PropertyName="FontFamily", ValueToSet=xaml)

# ----
grid = CreateGrid(UIElements=merge, ColumnDefinitions=panel_2, ElementColumn=panel, ElementRowSpan=1, ElementColumnSpan=1)
launchwin = LaunchWindow(Show=Toggle(True), Name="Control Window", Width=370, Height=400, ChildStatus=0, EnableHorizScroll=False)

# ---- group: Get Properties And Types
getprops = GetElementProperties(UIElement=toggle)  # -> PropertyNames, PropertyTypes
panel_4 = Panel(getprops.PropertyNames)
panel_5 = Panel(getprops.PropertyTypes)

# ---- group: Set H. Align to stretch
adjustpos = AdjustElementPositioning(ElementsToAdjust=merge, AbsolutePositioning=False, HorizontalAlignment=3)

# ----
addelems = AddElements(Window=launchwin, Elements=flatten([grid, toggle]), DoVLChecking=True)  # -> AddedElements, ElementNames
