# Grasshopper definition bb0585ffe534641664af64a5eb077fe93c6029be.ghx (Grasshopper 1.0.7)

pt = Point(<point referenced from the Rhino model>)
pt_2 = Point(<point referenced from the Rhino model>)
pt_3 = Point(<point referenced from the Rhino model>)
pt_4 = Point(<point referenced from the Rhino model>)
pt_5 = Point(<point referenced from the Rhino model>)

pt_6 = Point([Point(-96.39581943, 93.52781373, 0), Point(-107.1882057, 98.61067954, 0), Point(-95.83879304, 79.39326907, 0), Point(-107.8844887, 79.04512758, 0), Point(-114.9865752, 90.46416858, 0)])

bool = Boolean(True)
knots = KnotVector(Count=Slider(5, range=0..12), Degree=Slider(3, range=1..3), Periodic=bool)
nurbcrv = NurbsCurve(
    Points=pt_6,
    Weights=[Slider(0.4, range=0.4..10), Slider(0.4, range=0.4..10), Slider(0.4, range=0.4..10), Slider(0.4, range=0.4..10), Slider(0.4, range=0.4..10)],
    Knots=knots)  # -> Curve, Length, Domain

crv = Curve([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])
boundary = BoundarySurfaces(Edges=crv)
avr = Average(Input=pt_6)
srfsplit = SurfaceSplit(Surface=boundary, Curves=crv)
cir = Circle(Plane=avr, Radius=1)
crv_2 = Curve(srfsplit)
alongcrv = SortAlongCurve(Points=pt_6, Curve=cir)  # -> Points, Indices
explode = Explode(Curve=crv_2, Recursive=True)  # -> Segments, Vertices
pline = PolyLine(Vertices=alongcrv.Points, Closed=invert(False))
cull_i = CullIndex(List=explode.Vertices, Indices="-1", Wrap=True)
curvepoint = PointOnCurve(explode.Segments, parameter=0.5)
explode_2 = Explode(Curve=pline, Recursive=True)  # -> Segments, Vertices
shift = ShiftList(List=curvepoint, Shift=1, Wrap=True)
shift_2 = ShiftList(List=cull_i, Shift=1, Wrap=True)
curvepoint_2 = PointOnCurve(explode_2.Segments, parameter=0.5)
cull_i_2 = CullIndex(List=explode_2.Vertices, Indices="-1", Wrap=True)
merge = Merge(Data1=simplify(graft(curvepoint)), Data2=simplify(graft(shift_2)), Data3=simplify(graft(shift)))
number_slider = Slider(0.4, range=0.4..10)
shift_3 = ShiftList(List=curvepoint_2, Shift=1, Wrap=True)
shift_4 = ShiftList(List=cull_i_2, Shift=1, Wrap=True)
number_slider_2 = Slider(1, range=0.4..10)
merge_2 = Merge(Data1=simplify(graft(curvepoint_2)), Data2=simplify(graft(shift_4)), Data3=simplify(graft(shift_3)))
merge_3 = Merge(Data1=number_slider, Data2=Slider(1, range=0.4..10), Data3=number_slider)
knots_2 = KnotVector(Count=Slider(3, range=0..12), Degree=Slider(2, range=1..3), Periodic=Toggle(False))
nurbcrv_2 = NurbsCurve(Points=merge, Weights=merge_3, Knots=knots_2)  # -> Curve, Length, Domain

# ---- group: 10 points
weave = Weave(Pattern=[0, 1], Stream0=curvepoint_2, Stream1=shift_4, NullGaps=False)
nurbs = NurbsCurve(Vertices=weave, Degree="3", Periodic=invert(False))  # -> Curve, Length, Domain

# ----
merge_4 = Merge(Data1=number_slider_2, Data2=Slider(1, range=0.4..10), Data3=number_slider_2)
knots_3 = KnotVector(Count=Slider(3, range=0..12), Degree=Slider(2, range=1..3), Periodic=Toggle(False))

# ---- group: 5 points
nurbs_2 = NurbsCurve(Vertices=cull_i_2, Degree="3", Periodic=invert(False))  # -> Curve, Length, Domain

# ----
pshift = ShiftPaths(Data=nurbcrv_2.Curve, Offset=-1)
nurbcrv_3 = NurbsCurve(Points=merge_2, Weights=merge_4, Knots=knots_3)  # -> flatten(Curve), Length, Domain
join = JoinCurves(Curves=pshift, Preserve=False)  # -> flatten(Curves)
panel = Panel(nurbs.Curve)
panel_2 = Panel(nurbs_2.Curve)
join_2 = JoinCurves(Curves=nurbcrv_3.Curve, Preserve=False)
panel_3 = Panel(join_2)
panel_4 = Panel(join)
