# Grasshopper definition c925501232078dc78eae74335520f0f4ef5efba2.ghx (Grasshopper 1.0.7)
# plug-ins: Kangaroo2 Components

custom_mesh_settings = SettingsCustom(
    StitchSeams=True,
    SimplePlanes=False,
    Refine=True,
    MinCount=16,
    MaxCount=400,
    AspectRatio=20,
    MaxDistance=0,
    MaxAngle=20,
    MinEdge="3",
    MaxEdge="3")
srf = Surface(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)
mesh = MeshBrep(Brep=srf, Settings=custom_mesh_settings)
corners = Corners(mesh=mesh)
panel = Panel("""1
2""")
item = ListItem(List=corners, Index=panel, Wrap=True)
Z = UnitZ(Factor=Slider(39, range=0..100))
edgelengths = EdgeLengths(Mesh=mesh, LengthFactor=Slider(0.54, range=0..1), Strength=1)
move = Move(Geometry=item, Motion=Z)  # -> Geometry, Transform
replace = ReplaceItems(List=corners, Item=move.Geometry, Indices=panel, Wrap=False)
anchor = Anchor(Point=corners, Target=replace, Strength=10000)
show = Show(G=mesh)
bouncysolver = BouncySolver(
    GoalObjects=[anchor, show, edgelengths],
    Reset=Button(),
    Threshold=1e-15,
    Tolerance=0.01,
    Damping=0.99,
    Iterations=20,
    On=Toggle(True))  # -> I, V, O
clean = CleanTree(RemoveNulls=True, RemoveInvalid=True, RemoveEmpty=False, Tree=bouncysolver.O)

# ==== cluster Corners: Find the boundary corner points of a quad mesh
mesh = ClusterInput()
mesh_2 = Mesh(mesh)
nv = NakedVertices(Mesh=mesh_2)  # -> ClothedIndex, NakedIndex, ClothedPts, NakedPts
vn = VertexNeighbours(Mesh=mesh_2, VertexNumber=nv.NakedIndex)  # -> graft(Vertex), Neighbours, Normal
lng = ListLength(List=vn.Neighbours)
equals = Equality(FirstNumber=lng, SecondNumber=3)  # -> Equality, Inequality
cull = CullPattern(List=vn.Vertex, CullPattern=equals.Inequality)
pshift = ShiftPaths(Data=cull, Offset=-1)
D = ClusterOutput(pshift)
