# Grasshopper definition cdaef75096c9e28bc6befe64b8a2f03dc212b43c.ghx (Grasshopper 1.0.7)

number_slider = Slider(3.1, range=0..4)
number_slider_2 = Slider(0.65, range=0..4)
planesrf = PlaneSurface(Plane=PlaneXY(0, 0, 0), XSize=number_slider_2, YSize=number_slider)
popgeo = PopulateGeometry(Geometry=planesrf, Count=Slider(30, range=0..1000), Seed=Slider(100, range=0..100))
neg = Negative(Value=number_slider)
neg_2 = Negative(Value=number_slider_2)
X = UnitX(Factor=number_slider_2)
X_2 = UnitX(Factor=neg_2)
Y = UnitY(Factor=number_slider)
Y_2 = UnitY(Factor=neg)
multiplication = Multiplication(A=number_slider, B=2)
move = Move(Geometry=popgeo, Motion=X)  # -> Geometry, Transform
move_2 = Move(Geometry=popgeo, Motion=X_2)  # -> Geometry, Transform
multiplication_2 = Multiplication(A=number_slider_2, B=2)
neg_3 = Negative(Value=number_slider)
neg_4 = Negative(Value=number_slider_2)
dom = ConstructDomain(DomainStart=neg_3, DomainEnd=multiplication)
dom_2 = ConstructDomain(DomainStart=neg_4, DomainEnd=multiplication_2)
pt = Point([popgeo, move.Geometry, move_2.Geometry])
move_3 = Move(Geometry=pt, Motion=Y)  # -> Geometry, Transform
move_4 = Move(Geometry=pt, Motion=Y_2)  # -> Geometry, Transform
rectangle = Rectangle(Plane=PlaneXY(0, 0, 0), XSize=dom_2, YSize=dom, Radius=0)  # -> Rectangle, Length
pt_2 = Point([pt, move_3.Geometry, move_4.Geometry])
number_slider_3 = Slider(0.03, range=0..0.1)
voronoi = Voronoi(Points=pt_2, Boundary=rectangle.Rectangle, BruteForceOverride=False)
pcen = PolygonCenter(Polyline=voronoi)  # -> CenterV, CenterE, CenterA
Z = UnitZ(Factor=number_slider_3)
neg_5 = Negative(Value=Slider(1, range=0..1))
Z_2 = UnitZ(Factor=expr("-X", number_slider_3))
move_5 = Move(Geometry=planesrf, Motion=Z)  # -> Geometry, Transform
Z_3 = UnitZ(Factor=neg_5)
scale = Scale(Geometry=voronoi, Center=pcen.CenterV, Factor=Slider(0.95, range=0..1))  # -> Geometry, Transform
scale_2 = Scale(Geometry=voronoi, Center=pcen.CenterV, Factor=Slider(0.52, range=0..1))  # -> Geometry, Transform
extr = Extrude(Base=move_5.Geometry, Direction=Z_3)
move_6 = Move(Geometry=scale_2.Geometry, Motion=Z_2)  # -> Geometry, Transform
merge = Merge(Data1=graft(scale.Geometry), Data2=graft(move_6.Geometry))
crv = Curve(flatten(scale.Geometry))
boundary = BoundarySurfaces(Edges=[rectangle.Rectangle, crv])
loft = Loft(Curves=merge, Options={Adjust=False, Closed=False, LoftEnds=0, LoftSimp=0, LoftType=0, Rebuild=10, Refit=0.01})
boundary_2 = BoundarySurfaces(Edges=move_6.Geometry)
join = BrepJoin(Breps=flatten([boundary, loft, boundary_2]))  # -> Breps, Closed
panel = Panel(join.Breps)
split = SplitBrep(Brep=join.Breps, Cutter=extr)
item = ListItem(List=split, Index="1", Wrap=True)
rec = Rectangle(planesrf)
arrrec = RectangularArray(Geometry=item, Cell=rec, XCount=Slider(3, range=0..20), YCount=Slider(6, range=0..20))  # -> Geometry, Transform

join_2 = BrepJoin(Breps=arrrec.Geometry)  # -> Breps, Closed
panel_2 = Panel(join_2.Breps)

preview = CustomPreview(Geometry=join_2.Breps, Material=ColourSwatch(SwatchColor=RGB(133, 161, 166)))
