# Grasshopper definition d85cd818771cd77777d008033203d73dd36def03.ghx (Grasshopper 1.0.5)
# plug-ins: LunchBox

srf = Surface(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)
hex = HexagonCells(Surface=srf, UDivisions=Slider(33, range=0..100), VDivisions=Slider(9, range=0..100), TParameter=0.25)  # -> HexagonCells, Centers
openings = Slider(0.8, range=0..1)
explode = Explode(Curve=hex.HexagonCells, Recursive=True)  # -> Segments, Vertices
pt = Point(hex.Centers)
lng = ListLength(List=explode.Segments)
eval = Evaluate(F=Slider(6, range=0..10), x=lng)
cull = CullPattern(List=pt, CullPattern=flatten(eval))

# ---- group: Center_Attractor
item = ListItem(List=cull, Index=92, Wrap=True)
pt_2 = Point([Point(182.0954402, 107.3810433, 0), Point(185.5358651, 123.4263438, 0), Point(190.5314943, 139.1577881, 0), Point(197.0286998, 154.351763, 0), Point(204.9317905, 168.7985843, 0), Point(183.6033259, 115.5014289, 30.575823)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])
dist = Distance(PointA=item, PointB=pt_2)
bnd = Bounds(Numbers=dist)
dom = ConstructDomain(DomainStart=Slider(0.8, range=0..1), DomainEnd=Slider(0.02, range=0..1))
remap = RemapNumbers(Value=dist, Source=bnd, Target=dom)  # -> Mapped, Clipped

# ----
cull_2 = CullPattern(List=hex.HexagonCells, CullPattern=flatten(eval))
scale = Scale(Geometry=cull_2, Center=cull, Factor=remap.Mapped)  # -> Geometry, Transform

disc = Discontinuity(Curve=scale.Geometry, Level=1)  # -> Points, Parameters
tstat = TreeStatistics(Tree=disc.Points)  # -> Paths, Length, Count
larger = LargerThan(FirstNumber=tstat.Length, SecondNumber=Slider(5, range=0..12))  # -> LargerThan, OrEqualTo
cull_3 = CullPattern(List=scale.Geometry, CullPattern=larger.LargerThan)
crv = Curve(cull_3)

preview = CustomPreview(Geometry=scale.Geometry, Material=ColourSwatch(SwatchColor=RGB(207, 207, 207)))
merge = Merge(Data1=graft(cull_2), Data2=graft(scale.Geometry))
scale_2 = Scale(Geometry=scale.Geometry, Center=cull, Factor=openings)  # -> Geometry, Transform
srf_cp = SurfaceClosestPoint(Point=cull, Surface=srf)  # -> Point, UVPoint, Distance
loft = Loft(Curves=merge, Options={Adjust=False, Closed=False, LoftEnds=0, LoftSimp=0, LoftType=0, Rebuild=10, Refit=0.01})
evalsrf = EvaluateSurface(Surface=srf, Point=srf_cp.UVPoint)  # -> Point, Normal, UDirection, VDirection, Frame
multiplication = Multiplication(A=evalsrf.Normal, B=Slider(-1.943, range=-10..0))
move = Move(Geometry=scale_2.Geometry, Motion=multiplication)  # -> Geometry, Transform
merge_2 = Merge(Data1=graft(move.Geometry), Data2=graft(scale.Geometry))
loft_2 = Loft(Curves=merge_2, Options={Adjust=False, Closed=False, LoftEnds=0, LoftSimp=0, LoftType=0, Rebuild=10, Refit=0.01})
