# Grasshopper definition da261815312913df2cc268e2b12df20ac04b06a7.ghx (Grasshopper 1.0.7)

crv = Curve(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)
offset = OffsetCurve(Curve=crv, Distance="0.5", Plane=PlaneXY(0, 0, 0), Corners=1)  # -> reparameterize(Curve)
len = Length(Curve=offset)
divide = DivideCurve(Curve=offset, Count=len, Kinks=False)  # -> Points, Tangents, Parameters
addition = Addition(A=divide.Parameters, B="0.001")
subtraction = Subtraction(A=divide.Parameters, B="0.001")
round = Round(Number=addition)  # -> Nearest, Floor, Ceiling
round_2 = Round(Number=subtraction)  # -> Nearest, Floor, Ceiling
subtraction_2 = Subtraction(A=addition, B=round.Floor)
subtraction_3 = Subtraction(A=subtraction, B=round_2.Floor)
eval = EvaluateCurve(Curve=offset, Parameter=subtraction_2)  # -> Point, Tangent, Angle
eval_2 = EvaluateCurve(Curve=offset, Parameter=subtraction_3)  # -> Point, Tangent, Angle
xy = XYPlane(Origin=Point(0, 0, 0))
angle = Angle(VectorA=eval.Tangent, VectorB=eval_2.Tangent, Plane=xy)  # -> Angle, Reflex
list = ValueList({"One": 1, "Two": 2, "Three": 2² - 1, "Four": Sqrt(16)}, selected="Two")
division = Division(A=angle.Angle, B=list)
rotate = Rotate(Geometry=eval.Tangent, Angle=division, Plane=PlaneXY(0, 0, 0))  # -> Geometry, Transform
xy_2 = XYPlane(Origin=Point(0, 0, 0))
X = UnitX(Factor=1)
box = CenterBox(Base=divide.Points, X="0.5", Y="0.5", Z="0.5")
angle_2 = Angle(VectorA=rotate.Geometry, VectorB=X, Plane=xy_2)  # -> Angle, Reflex
sort = SortList(Keys=angle_2.Angle, ValuesA=box)  # -> Keys, ValuesA
cset = CreateSet(List=sort.Keys)  # -> Set, Map
mindex = MemberIndex(Set=sort.Keys, Member=cset.Set)  # -> Index, Count
merge = Merge(
    Data1=ColourSwatch(SwatchColor=RGB(255, 255, 255)),
    Data2=ColourSwatch(SwatchColor=RGB(0, 0, 0)),
    Data3=ColourSwatch(SwatchColor=RGB(255, 0, 0)),
    Data4=ColourSwatch(SwatchColor=RGB(255, 0, 255)),
    Data5=ColourSwatch(SwatchColor=RGB(0, 0, 255)),
    Data6=ColourSwatch(SwatchColor=RGB(0, 255, 255)),
    Data7=ColourSwatch(SwatchColor=RGB(0, 255, 0)),
    Data8=ColourSwatch(SwatchColor=RGB(255, 255, 0)))
partition = PartitionList(List=sort.ValuesA, Size=mindex.Count)  # -> simplify(Chunks)
preview = CustomPreview(Geometry=partition, Material=graft(merge))
