# Grasshopper definition dbc15f8858cfd2e8d61db4672fe0788a4e4f5dc7.ghx (Grasshopper 1.0.7)

crv = Curve(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)
rail = Geometry([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])
pframes = PerpFrames(Curve=crv, Count=500, Align=True)  # -> Frames, Parameters
cir = Circle(Plane=pframes.Frames, Radius=Slider(10, range=0..10))
loft = Loft(Curves=cir, Options={Adjust=False, Closed=False, LoftEnds=0, LoftSimp=0, LoftType=0, Rebuild=10, Refit=0.01})
cap = CapHoles(Brep=loft)
join = BrepJoin(Breps=[cap, rail])  # -> Breps, Closed
