# Grasshopper definition dd9dd08d023a54f0448994a70e547230aabb3519.ghx (Grasshopper 1.0.7)

# ---- group: Finding the result / ClosedCrvs
crv = Curve([<curve referenced from the Rhino model> x3])

# ---- group: Finding the result / Vertical Lines
crv_2 = Curve([<curve referenced from the Rhino model> x3])

# ---- group: Finding the result
curvepoint = PointOnCurve(crv_2, parameter=0.5)
project = Project(Geometry=curvepoint, Plane=PlaneXY(0, 0, 0))  # -> Geometry, Transform
project_2 = Project(Geometry=crv, Plane=PlaneXY(0, 0, 0))  # -> Geometry, Transform
incurve = PointInCurve(Point=graft(project.Geometry), Curve=project_2.Geometry)  # -> Relationship, Point
expression = Expression(x=incurve.Relationship, Expression="x=2")
cull = CullPattern(List=crv, CullPattern=expression)
item = ListItem(List=cull, Index=1, Wrap=True)  # -> flatten(Item)

# ---- group: showing the results
disc = Discontinuity(Curve=crv, Level=1)  # -> Points, Parameters
item_2 = ListItem(List=disc.Points, Index=0, Wrap=True)  # -> flatten(Item)
lng = ListLength(List=item_2)
series = Series(Start=0, Step=1, Count=lng)
cull_2 = CullPattern(List=series, CullPattern=expression)
item_3 = ListItem(List=cull_2, Index=1, Wrap=True)  # -> flatten(Item)
tag = TextTag3D(Location=curvepoint, Text=item_3, Size=2000, Colour=RGB(0, 0, 0), Justification=5)
tag_2 = TextTag3D(Location=item_2, Text=series, Size=2000, Colour=RGB(255, 255, 255), Justification=5)
