# Grasshopper definition df495d15a9e399044ee2ce6a63fba7fb590aa76c.ghx (Grasshopper 1.0.7)
# plug-ins: Pufferfish

number_slider = Slider(2, range=0..10)
number_slider_2 = Slider(16, range=0..20)

# ---- group: ORIGINE
pt = ConstructPoint(XCoordinate=0, YCoordinate=0, ZCoordinate=0)
sph = Sphere(Base=pt, Radius=1)

# ----
knob = ControlKnob(Decimals=0, Limit=True, Maximum=100, Minimum=0, Range=100, Value=40)
knob_2 = ControlKnob(Decimals=0, Limit=True, Maximum=100, Minimum=0, Range=100, Value=64)
number_slider_3 = Slider(0.2, range=0..1)
dom = ConstructDomain(DomainStart=Slider(0.03, range=0..1), DomainEnd=Slider(0.57, range=0..1))
pt_2 = Point(pt)
dom_2 = ConstructDomain(DomainStart=expr("-x", number_slider_3), DomainEnd=number_slider_3)

# ---- group: SPHERE BASES
series = Series(Start=number_slider, Step=number_slider, Count=number_slider_2)
series_2 = Series(Start=expr("-x/2", number_slider), Step=expr("x/4", number_slider), Count=expr("x-1", number_slider_2))  # -> expr("-x", Series)
scale = Scale(Geometry=sph, Center=pt, Factor=series)  # -> flatten(Geometry), Transform
preview = CustomPreview(Geometry=scale.Geometry, Shader=ColourSwatch(SwatchColor=RGBA(0, 132, 255, 46)))
graph = GraphMapper(
    series_2,
    x0=1,
    x1=2,
    y0=1,
    y1=2,
    Ox=0.546387136,
    Oy=0.2111679316,
    Px=0.8786957264,
    Py=0.2008695602,
    container_name="Parabola")
geo = Geometry(simplify(flatten(scale.Geometry)))
panel = Panel("""0
-1""")
item = ListItem(List=geo, Index=panel, Wrap=True)
cull_i = CullIndex(List=geo, Indices=panel, Wrap=True)  # -> graft(List)
item_2 = ListItem(List=item, Index=0, Wrap=True)  # -> Item, Item1
dup = DuplicateData(Data=cull_i, Number=2, Order=False)  # -> flatten(Data)
merge = Merge(Data1=flatten(item_2.Item), Data2=flatten(dup), Data3=flatten(item_2.Item1))
partition = PartitionList(List=merge, Size="2")  # -> simplify(Chunks)
item_3 = ListItem(List=partition, Index=0, Wrap=True)  # -> Item, Item1

# ---- group: PLANS BASES
multiplication = Multiplication(A=number_slider, B=number_slider_2)
dom_3 = ConstructDomain(DomainStart=multiplication, DomainEnd=expr("-x", multiplication))
rectangle = Rectangle(Plane=pt, XSize=dom_3, YSize=dom_3, Radius=0)  # -> Rectangle, Length
boundary = BoundarySurfaces(Edges=rectangle.Rectangle)
multiplication_2 = Multiplication(A=series_2, B=graph)
Z = UnitZ(Factor=multiplication_2)
move = Move(Geometry=boundary, Motion=expr("-x", Z))  # -> simplify(graft(Geometry)), Transform
multiplication_3 = Multiplication(A=multiplication, B=4)
Z_2 = UnitZ(Factor=multiplication_3)
extr = Extrude(Base=move.Geometry, Direction=Z_2)  # -> simplify(Extrusion)
sdiff = SolidDifference(BrepsA=item_3.Item1, BrepsB=extr)  # -> graft(Result)

# ---- group: AXE
neg = Negative(Value=multiplication)
merge_2 = Merge(Data1=multiplication, Data2=neg)
Z_3 = UnitZ(Factor=merge_2)
move_2 = Move(Geometry=pt, Motion=Z_3)  # -> Geometry, Transform
item_4 = ListItem(List=move_2.Geometry, Index=0, Wrap=True)  # -> Item, Item1
ln = Line(StartPoint=item_4.Item, EndPoint=item_4.Item1)

# ---- group: SPHERE BASES (continued)
sdiff_2 = SolidDifference(BrepsA=sdiff, BrepsB=item_3.Item)  # -> simplify(Result)
sunion = SolidUnion(Breps=flatten(sdiff_2))
preview_2 = CustomPreview(Geometry=sunion, Shader=ColourSwatch(SwatchColor=RGBA(43, 124, 217, 80)))

# ---- group: Middle curves
debrep = DeconstructBrep(Brep=sdiff_2)  # -> Faces, Edges, Vertices
item_5 = ListItem(List=debrep.Edges, Index=Slider(1, range=0..10), Wrap=True)  # -> simplify(Item)
item_6 = ListItem(List=debrep.Edges, Index=Slider(3, range=0..10), Wrap=True)  # -> simplify(Item)
item_7 = ListItem(List=item_6, Index=0, Wrap=True)
flip = FlipCurve(Curve=item_5, Guide=item_7)  # -> Curve, Flag
twn2crvs = TweenTwoCurves(CurveA=item_6, CurveB=flip.Curve, Factor=0.5, Refit=0, PointSample=0)

# ----
crv = Curve(item_7)
area = Area(Geometry=twn2crvs)  # -> Area, Centroid
crv_2 = Curve(reparameterize(simplify(twn2crvs)))
crv_cp = CurveClosestPoint(Point=area.Centroid, Curve=twn2crvs)  # -> Point, Parameter, Distance
dist = Distance(PointA=area.Centroid, PointB=crv_cp.Point)
integer_division = IntegerDivision(A=dist, B=1)  # -> flatten(Result)
ma = MassAddition(Input=integer_division)  # -> Result, PartialResults
random = Random(Range=Domain(0, 1), Number=ma.Result, Seed=knob)  # -> flatten(Random)
partition_2 = PartitionList(List=random, Size=integer_division)
panel_2 = Panel(ma.Result)
eval = EvaluateCurve(Curve=crv_2, Parameter=partition_2)  # -> simplify(Point), Tangent, Angle
rev = ReverseList(List=integer_division)
ln_2 = Line(StartPoint=area.Centroid, EndPoint=eval.Point)
flip_2 = FlipMatrix(Data=rev)
ccx = CurveCurve(CurveA=crv, CurveB=ln_2)  # -> Points, ParamsA, ParamsB
unflatten = UnflattenTree(Tree=ccx.Points, Guide=eval.Point)
bnd = Bounds(Numbers=flatten(flip_2))
remap = RemapNumbers(Value=flip_2, Source=bnd, Target=dom)  # -> Mapped, Clipped
dist_2 = Distance(PointA=pt_2, PointB=unflatten)
graph_2 = GraphMapper(
    remap.Mapped,
    x0=0,
    x1=1,
    y0=0,
    y1=1,
    container_name="Sine",
    Equation_px=[0, 0.3740150332],
    Equation_py=[0, 0.3960093856])
dist_3 = Distance(PointA=pt_2, PointB=eval.Point)
Z_4 = UnitZ(Factor=dist_2)
Z_5 = UnitZ(Factor=dist_3)
move_3 = Move(Geometry=pt_2, Motion=expr("-x", Z_4))  # -> Geometry, Transform
move_4 = Move(Geometry=pt_2, Motion=Z_4)  # -> Geometry, Transform
repeat = RepeatData(Data=graph_2, Length=graft(integer_division))  # -> simplify(Data)
move_5 = Move(Geometry=pt_2, Motion=expr("-x", Z_5))  # -> Geometry, Transform
move_6 = Move(Geometry=pt_2, Motion=Z_5)  # -> Geometry, Transform
lng = ListLength(List=repeat)
arc = Arc3Pt(PointA=move_4.Geometry, PointB=unflatten, PointC=move_3.Geometry)  # -> graft(Arc), Plane, Radius
random_2 = Random(Range=dom_2, Number=lng, Seed=knob_2)  # -> simplify(Random)
arc_2 = Arc3Pt(PointA=move_5.Geometry, PointB=eval.Point, PointC=move_6.Geometry)  # -> graft(Arc), Plane, Radius
crv_cp_2 = CurveClosestPoint(Point=graft(unflatten), Curve=arc.Arc)  # -> Point, Parameter, Distance
abs = Absolute(Value=random_2)
crv_cp_3 = CurveClosestPoint(Point=graft(eval.Point), Curve=arc_2.Arc)  # -> Point, Parameter, Distance
shatter = Shatter(Curve=arc.Arc, Parameters=crv_cp_2.Parameter)
addition = Addition(A=repeat, B=abs)  # -> simplify(Result)
shatter_2 = Shatter(Curve=arc_2.Arc, Parameters=crv_cp_3.Parameter)
cull_i_2 = CullIndex(List=shatter, Indices=1, Wrap=True)
cull_i_3 = CullIndex(List=shatter_2, Indices=0, Wrap=True)
unflatten_2 = UnflattenTree(Tree=cull_i_2, Guide=move_4.Geometry)
unflatten_3 = UnflattenTree(Tree=cull_i_3, Guide=move_5.Geometry)
crv_3 = Curve(reparameterize(unflatten_3))
eval_2 = EvaluateCurve(Curve=crv_3, Parameter=addition)  # -> Point, Tangent, Angle
crv_cp_4 = CurveClosestPoint(Point=eval_2.Point, Curve=crv_3)  # -> Point, Parameter, Distance
crv_4 = Curve(unflatten_2)
shatter_3 = Shatter(Curve=graft(crv_3), Parameters=graft(crv_cp_4.Parameter))
line = Line(ln)
cull_i_4 = CullIndex(List=shatter_3, Indices=1, Wrap=True)  # -> simplify(List)
pdecon = Deconstruct(Point=crv_cp_4.Point)  # -> XComponent, YComponent, ZComponent
smaller = SmallerThan(FirstNumber=pdecon.ZComponent, SecondNumber="0")  # -> SmallerThan, OrEqualTo
unflatten_4 = UnflattenTree(Tree=cull_i_4, Guide=crv_3)
dispatch = Dispatch(List=crv_4, DispatchPattern=smaller.OrEqualTo)  # -> ListA, ListB
dispatch_2 = Dispatch(List=unflatten_4, DispatchPattern=smaller.OrEqualTo)  # -> ListA, ListB
crv_5 = Curve(dispatch_2.ListA)
crv_6 = Curve(dispatch_2.ListB)
crv_7 = Curve(dispatch.ListA)
crv_8 = Curve(dispatch.ListB)
end = EndPoints(Curve=crv_5)  # -> Start, End
end_2 = EndPoints(Curve=crv_6)  # -> Start, End
crv_cp_5 = CurveClosestPoint(Point=end.End, Curve=line)  # -> Point, Parameter, Distance
ln_3 = Line(StartPoint=end_2.End, EndPoint=pt_2)
ccx_2 = CurveCurve(CurveA=crv_8, CurveB=ln_3)  # -> Points, ParamsA, ParamsB
ln_4 = Line(StartPoint=crv_cp_5.Point, EndPoint=end.End)
ccx_3 = CurveCurve(CurveA=crv_7, CurveB=ln_4)  # -> Points, ParamsA, ParamsB
trim = TrimTree(Tree=ccx_2.Points, Depth=1)
trim_2 = TrimTree(Tree=ccx_3.Points, Depth=1)
crv_cp_6 = CurveClosestPoint(Point=trim, Curve=crv_8)  # -> Point, Parameter, Distance
crv_cp_7 = CurveClosestPoint(Point=trim_2, Curve=crv_7)  # -> Point, Parameter, Distance
shatter_4 = Shatter(Curve=graft(crv_7), Parameters=graft(crv_cp_7.Parameter))  # -> simplify(Segments)
shatter_5 = Shatter(Curve=graft(crv_8), Parameters=graft(crv_cp_6.Parameter))  # -> simplify(Segments)
cull_i_5 = CullIndex(List=shatter_4, Indices=0, Wrap=True)
unflatten_5 = UnflattenTree(Tree=cull_i_5, Guide=crv_7)
cull_i_6 = CullIndex(List=shatter_5, Indices=0, Wrap=True)
end_3 = EndPoints(Curve=unflatten_5)  # -> Start, End
unflatten_6 = UnflattenTree(Tree=cull_i_6, Guide=crv_6)
ln_5 = Line(StartPoint=end.End, EndPoint=end_3.Start)
ln_6 = Line(StartPoint=end_3.End, EndPoint=end.Start)
end_4 = EndPoints(Curve=unflatten_6)  # -> Start, End
merge_3 = Merge(Data1=ln_5, Data2=unflatten_5, Data3=ln_6, Data4=crv_5)  # -> flatten(Result)
ln_7 = Line(StartPoint=end_2.End, EndPoint=end_4.Start)
ln_8 = Line(StartPoint=end_4.End, EndPoint=end_2.Start)
merge_4 = Merge(Data1=cull_i_6, Data2=ln_7, Data3=crv_6, Data4=ln_8)  # -> flatten(Result)
join = JoinCurves(Curves=merge_3, Preserve=False)
unflatten_7 = UnflattenTree(Tree=join, Guide=crv_5)
join_2 = JoinCurves(Curves=merge_4, Preserve=False)
unflatten_8 = UnflattenTree(Tree=join_2, Guide=ln_7)
match = MatchTree(Tree=[unflatten_7, unflatten_8], Guide=unflatten_3)
bang = ExplodeTree(Data=crv_6)  # -> Branch0, Branch1, Branch2, Branch3, Branch4, Branch5, Branch6, Branch7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
bang_2 = ExplodeTree(Data=match)  # -> Branch0, Branch1, Branch2, Branch3, Branch4, Branch5, Branch6, Branch7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
crv_9 = Curve(bang.Branch0)
crv_10 = Curve(bang_2.Branch0)

eval_3 = EvaluateCurve(Curve=crv_2, Parameter=partition_2)  # -> simplify(Point), Tangent, Angle
pt_3 = Point(pt)
crv_cp_8 = CurveClosestPoint(Point=eval_3.Point, Curve=crv)  # -> Point, Parameter, Distance
dist_4 = Distance(PointA=pt_3, PointB=eval_3.Point)
dist_5 = Distance(PointA=pt_3, PointB=crv_cp_8.Point)
Z_6 = UnitZ(Factor=dist_4)
Z_7 = UnitZ(Factor=dist_5)
move_7 = Move(Geometry=pt_3, Motion=expr("-x", Z_7))  # -> Geometry, Transform
move_8 = Move(Geometry=pt_3, Motion=expr("-x", Z_6))  # -> Geometry, Transform
move_9 = Move(Geometry=pt_3, Motion=Z_7)  # -> Geometry, Transform
move_10 = Move(Geometry=pt_3, Motion=Z_6)  # -> Geometry, Transform
arc_3 = Arc3Pt(PointA=move_9.Geometry, PointB=crv_cp_8.Point, PointC=move_7.Geometry)  # -> Arc, Plane, Radius
arc_4 = Arc3Pt(PointA=move_10.Geometry, PointB=eval_3.Point, PointC=move_8.Geometry)  # -> Arc, Plane, Radius
crv_cp_9 = CurveClosestPoint(Point=eval_3.Point, Curve=arc_4.Arc)  # -> Point, Parameter, Distance
crv_cp_10 = CurveClosestPoint(Point=crv_cp_8.Point, Curve=arc_3.Arc)  # -> Point, Parameter, Distance
shatter_6 = Shatter(Curve=graft(arc_3.Arc), Parameters=graft(crv_cp_10.Parameter))
shatter_7 = Shatter(Curve=graft(arc_4.Arc), Parameters=graft(crv_cp_9.Parameter))
cull_i_7 = CullIndex(List=shatter_6, Indices=1, Wrap=True)
cull_i_8 = CullIndex(List=shatter_7, Indices=1, Wrap=True)
pshift = ShiftPaths(Data=cull_i_7, Offset="-3")
pshift_2 = ShiftPaths(Data=cull_i_8, Offset="-3")
flip_3 = FlipCurve(Curve=pshift)  # -> Curve, Flag
flip_4 = FlipCurve(Curve=pshift_2)  # -> Curve, Flag
shatter_8 = Shatter(Curve=reparameterize(graft(flip_4.Curve)), Parameters=graft(addition))
shatter_9 = Shatter(Curve=reparameterize(graft(flip_3.Curve)), Parameters=graft(addition))
cull_i_9 = CullIndex(List=shatter_8, Indices="1", Wrap=True)
cull_i_10 = CullIndex(List=shatter_9, Indices="1", Wrap=True)
flip_5 = FlipCurve(Curve=cull_i_10)  # -> Curve, Flag
merge_5 = Merge(Data1=flip_5.Curve, Data2=cull_i_9)

connect = ConnectCurves(Curves=merge_5, Continuity=0, Close=True, Bulge=1)
pshift_3 = ShiftPaths(Data=connect, Offset="-3")
boundary_2 = BoundarySurfaces(Edges=pshift_3)

tstat = TreeStatistics(Tree=boundary_2)  # -> Paths, Length, Count
range = Range(Domain=Domain(0, 0.9), Steps=expr("x-1", tstat.Count))
hsl = ColourHSL(Alpha=1, Hue=range, Saturation=1, Luminance=0.5)
preview_3 = CustomPreview(Geometry=boundary_2, Shader=graft(hsl))

viewer = ParamViewer(pshift_3)
