# Grasshopper definition e128ae0accfd840aed7c3f00c91a5660280b03e6.ghx (Grasshopper 1.0.7)

number_slider = Slider(100, range=0..1000)
number_slider_2 = Slider(250, range=0..500)
rectangle = Rectangle(Plane=PlaneXY(0, 0, 0), XSize=number_slider, YSize=number_slider, Radius=0)  # -> Rectangle, Length
mplane = MeshPlane(Boundary=rectangle.Rectangle, WidthCount=number_slider_2, HeightCount=number_slider_2)  # -> Mesh, Area
demesh = DeconstructMesh(Mesh=mplane.Mesh)  # -> Vertices, Faces, Colours, Normals
srf_cp = SurfaceClosestPoint(Point=demesh.Vertices, Surface=reparameterize(rectangle.Rectangle))  # -> Point, UVPoint, Distance
image = ImageSampler(srf_cp.UVPoint, Filter="Value", Interpolate=False, Umax=1, Umin=0, Vmax=1, Vmin=0, Wrap=1)
image_2 = ImageSampler(srf_cp.UVPoint, Filter="Colour", Interpolate=False, Umax=1, Umin=0, Vmax=1, Vmin=0, Wrap=1)
bnd = Bounds(Numbers=image)
predefined_extrusion_height = Panel("""5
10
15""")
dedomain = DeconstructDomain(Domain=bnd)  # -> Start, End
dom = ConstructDomain(DomainStart=dedomain.End, DomainEnd=dedomain.Start)
lng = ListLength(List=predefined_extrusion_height)
div = DivideDomain(Domain=dom, Count=lng)
fdom = FindDomain(Domains=div, Number=image, Strict=False)  # -> Index, Neighbour
item = ListItem(List=predefined_extrusion_height, Index=fdom.Index, Wrap=True)
Z = UnitZ(Factor=item)
move = Move(Geometry=demesh.Vertices, Motion=Z)  # -> Geometry, Transform

conmesh = ConstructMesh(Vertices=move.Geometry, Faces=demesh.Faces, Colours=image_2)
msmooth = SmoothMesh(Mesh=conmesh, Strength=Slider(0.5, range=0..1), SkipNaked=True, Iterations=Slider(15, range=0..30))
