# Grasshopper definition e301780487585c643314d9eae2e93f6f2495ba52.ghx (Grasshopper 1.0.7)

srf = Surface(Tree({0;0;0}: [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], {0;0;1}: [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], {0;0;2}: [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], {0;0;3}: [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], {0;0;4}: [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], {0;0;5}: [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]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))
gallery = ImageGallery(
    CycleDelay=30,
    Randomize=False,
    UseLocalImages=True,
    UseRemoteImages=True,
    RemoteUrl="C:\Users\RMorelos\Desktop\Forum\2.jpg")
explode = Explode(Curve=srf, Recursive=True)  # -> Segments, Vertices
project = Project(Geometry=explode.Segments, Plane=PlaneXY(0, 0, 0))  # -> Geometry, Transform
end = EndPoints(Curve=graft(project.Geometry))  # -> Start, End
avr = Average(Input=[end.End, end.Start])  # -> flatten(ArithmeticMean)
pgroups = PointGroups(Points=avr, Distance="1")  # -> Groups, Indices
item = ListItem(List=flatten(explode.Segments), Index=pgroups.Indices, Wrap=True)
item_2 = ListItem(List=item, Index=0, Wrap=True)  # -> Item, Item1
flip = FlipCurve(Curve=item_2.Item, Guide=item_2.Item1)  # -> Curve, Flag
loft = Loft(
    Curves=[flip.Curve, item_2.Item1],
    Options={Adjust=False, Closed=False, LoftEnds=0, LoftSimp=0, LoftType=0, Rebuild=10, Refit=0.01})
preview = CustomPreview(
    Geometry=srf,
    Shader={diffuse=RGB(255, 105, 180), emission=RGB(76, 32, 54), shine=0.5, specular=RGB(255, 255, 255), transparency=0})
preview_2 = CustomPreview(Geometry=loft, Shader="blue")
