# Grasshopper definition e3617672819cb36d25e169deb1ccdcaf007d0042.ghx (Grasshopper 1.0.7)

# ----
# 1. A Point is Set at 0,0,0 and a Cosine Curve is created to be 400mm long. This Curve Forms the Base on the Y Axis
pt = Point(Point(0, 0, 0))
Y = UnitY(Factor=Slider(400, range=0..1000))
move = Move(Geometry=pt, Motion=Y)  # -> Geometry, Transform
steps = Slider(1, range=0..10)
dom = ConstructDomain(DomainStart=pt, DomainEnd=move.Geometry)
range = Range(Domain=dom, Steps=steps)
expression = Expression(A=Slider(20, range=0..1000), t=range, Expression="A*cos(t)")
pt_2 = ConstructPoint(XCoordinate=expression, YCoordinate=range, ZCoordinate=0)
intcrv = Interpolate(Vertices=pt_2, Degree=3, Periodic=False, KnotStyle=1)  # -> Curve, Length, Domain

# ----
# 2.0 The Curve is Divided into into the Number of Ribs for the Armature
# 
# In Order for this to work the Input Curve is Reparameterized, rebuilding the Curve between 0 & 1
number_slider = Slider(14, range=0..100)
divide = DivideCurve(Curve=reparameterize(intcrv.Curve), Count=number_slider, Kinks=False)  # -> Points, Tangents, Parameters

# ----
# 3.0 The Graph Mapper is used to re-assign the parameter values at each division points.
# 
# The shape of this graph impacts the shape of the object.
# 
# The output values are rather small and hence need to be multiplied by a value or scaled up.
# 
# The Number Slider effects the Z Axis of The Height of the Armature
graph = GraphMapper(
    divide.Parameters,
    x0=0,
    x1=1,
    y0=0,
    y1=1,
    amplitude=0.5048415661,
    container_name="Perlin",
    decay=0,
    frequency=0.586427927,
    x_offset=0.413572073,
    y_offset=0.5048415661)

multiplication = Multiplication(A=graph, B=Slider(152, range=0..1000))

# ----
# 4.0 A series of Arc a created along the XZ Plane in accordance with the Shape indicated by the Scaled Graph
xz = XZPlane(Origin=divide.Points)
arc = Arc(Plane=xz, Radius=multiplication, Angle=Domain(0, 3.141592654))  # -> Arc, Length

# ----
# 5.0 The Curves are then Lofted to Create the Base Geometry of the Armature
loft = Loft(Curves=arc.Arc, Options={Adjust=False, Closed=False, LoftEnds=0, LoftSimp=0, LoftType=0, Rebuild=10, Refit=0.01})

pattern_1 = Panel("""0,0
1,1
0,2
2,1
0,3
1,4
0,5
2,4
0,6
1,7""")
# (x,y)
# 
# Branch, Index
pattern_2 = Panel("""0,1
2,0
4,2
2,1
0,3
2,2
4,4
2,3
0,5
2,4
4,6
2,5
0,7
2,6
4,7""")

test = Panel("""0,0
0,1
0,2
0,3
0,4
0,5
0,6
0,7""")
test_2 = Panel("""0,0
1,1
0,2
1,3
0,4
1,5
0,6
1,7""")
panel = Panel(pattern_2)

# ----
# RIBS STRUCTURE
brep = Brep(loft)
cardboard_thickness = Slider(1.7, range=0..10)  # disabled

# ----
# 12.0 The Inital Lofted Surface is offset by 15mm to create a thickness of the ribs.
# 
# The Surface output is then linked back to become the Context Input of the Bounding Box,
#  this insures that the cutting planes fully cut all of the geometry of the ribs
distance = Slider(15, range=0..100)
offset = OffsetSurface(Surface=brep, Distance=distance, Retrim=True)

# ----
# 6.0 Bounding Box is Created and the Box Corners Extracted
bbox = BoundingBox(Content=offset, Plane=PlaneXY(0, 0, 0))  # -> Box, Box_2

box_corners = BoxCorners(Box=bbox.Box)  # -> CornerA, CornerB, CornerC, CornerD, CornerE, CornerF, CornerG, CornerH

# ----
# 7.0 Two Lines are Created on the X-Axis of the Box
ln = Line(StartPoint=box_corners.CornerA, EndPoint=box_corners.CornerB)
ln_2 = Line(StartPoint=box_corners.CornerC, EndPoint=box_corners.CornerD)

# ----
# 8.0 The Midpoint of the Curves are determined by using Point on Curve and Setting it to 0.5
# 
# The Lines are then connected to draw a line along the Y Axis in the Center of the Geometry
curvepoint = PointOnCurve(ln, parameter=0.5)
curvepoint_2 = PointOnCurve(ln_2, parameter=0.5)
ln_3 = Line(StartPoint=curvepoint, EndPoint=curvepoint_2)

# ----
# 15.0 The length component is used to measure the length of the Y Axis Curve, this comes from the line of the
# Bounding box to ensure it fits the whole shape. The ribs are then divided using the interger division tool,
# creating the spaces between the ribs. This division is then arrayed in a linear manner across the Y Axis according to the pre-established
# rib spacing, which is now also the number of ribs.
number_slider_2 = Slider(15, range=0..100)
len = Length(Curve=ln_3)
integer_division = IntegerDivision(A=len, B=number_slider_2)
Y_2 = UnitY(Factor=integer_division)
arrlinear = LinearArray(Geometry=ln, Direction=Y_2, Count=number_slider_2)  # -> Geometry, Transform

# ----
# 16.0 To Avoid having a rib right on the edge of the model,
# the linear array of the X Axis ribs are shifted in the Y direction 15mm
number_slider_3 = Slider(15, range=0..100)
Y_3 = UnitY(Factor=number_slider_3)
move_2 = Move(Geometry=arrlinear.Geometry, Motion=Y_3)  # -> Geometry, Transform

# ----
# 17.0 The geometry generated for the spacing of the ribs are then used to to generate cutting lines through the Y Axis
Z = UnitZ(Factor=Slider(400, range=0..1000))
move_3 = Move(Geometry=move_2.Geometry, Motion=Z)  # -> Geometry, Transform
edgesrf = EdgeSurface(CurveA=move_3.Geometry, CurveB=move_2.Geometry)

bbx = BrepBrep(BrepA=brep, BrepB=edgesrf)  # -> Curves, Points
# 18.0 Curves were generated between the cutting planes and the inner
# and offset geometrysto create the curves of the ribs on the X Axis
bbx_2 = BrepBrep(BrepA=edgesrf, BrepB=offset)  # -> Curves, Points

# ----
# 19.0 The generated curves are then used to create the rib
#  surfaces using the edge surface component
edgesrf_2 = EdgeSurface(CurveA=bbx.Curves, CurveB=bbx_2.Curves)  # disabled

# ----
# 9.0 The Centerline Curve, used to create the base geometry is moved 400mm in the X Axis
#   and used to create a surface which is polar array to form the Ribs on the Y Axis and a series of cutting planes. The Polar Array had to be shifted in the X Direction to Prevent Intersection
number_slider_4 = Slider(400, range=0..1000)
X = UnitX(Factor=number_slider_4)
move_4 = Move(Geometry=intcrv.Curve, Motion=X)  # -> Geometry, Transform
number_of_ribs_in_y_axis = Slider(22, range=0..100)
sweep_angle_of_array = Slider(180, range=0..1000)
xz_2 = XZPlane(Origin=Point(0, 0, 0))
edgesrf_3 = EdgeSurface(CurveA=intcrv.Curve, CurveB=move_4.Geometry)

X_2 = UnitX(Factor=Slider(11, range=-10..30))
move_5 = Move(Geometry=edgesrf_3, Motion=X_2)  # -> Geometry, Transform

arrpolar = PolarArray(Geometry=move_5.Geometry, Plane=xz_2, Count=number_of_ribs_in_y_axis, Angle=degrees(sweep_angle_of_array))  # -> Geometry, Transform

# ----
# 10.0 The Cutting Planes are Rotated Slightly so none of the Ribs touch the ground
number_slider_5 = Slider(4, range=0..10)
xz_3 = XZPlane(Origin=Point(0, 0, 0))
rotate = Rotate(Geometry=arrpolar.Geometry, Angle=degrees(number_slider_5), Plane=xz_3)  # -> Geometry, Transform

# ----
# 11. Using the Brep/Brep Tool a curve is drawn on the intersection of the
#  cutting planes and the base geometry
bbx_3 = BrepBrep(BrepA=brep, BrepB=rotate.Geometry)  # -> Curves, Points

# ----
# 13.0 Curves are drawn on the offset geometry and where it intersects with the rotated cutting
#  planes, using the Brep Brep intersect component
bbx_4 = BrepBrep(BrepA=offset, BrepB=rotate.Geometry)  # -> Curves, Points

# ----
# A. The offset curves of the Y Axis ribs are divided.
# The rib is considered to be a branch and each point along the curve has an index which identifies it.
# This is a data tree.
# 
# The data in this tree is simplified for ease of reading and flatterned to make the branch number the x
#  in the situation (0; X) and the index number based of that.
number_slider_6 = Slider(7, range=0..10)
divide_2 = DivideCurve(Curve=simplify(flatten(bbx_4.Curves)), Count=number_slider_6, Kinks=False)  # -> Points, Tangents, Parameters

# ----
# 0
# Allow for the rotation of the intital pattern across the whole x Axis.
#  Because the matrix is flipped before and after the shift list,
# it is able to rotate around the correct axis
flip = FlipMatrix(Data=divide_2.Points)

shift = ShiftList(List=flip, Shift=Slider(0, range=0..10), Wrap=True)

# ----
# B By flipping the matrix, the branches and indexes are reversed, hence allowing for the branches to be along the x axis once more
flip_2 = FlipMatrix(Data=shift)  # -> simplify(Data)

# ----
# 14.0 The curves created by the inner and outer brep/brep
# components are used to create the edge surface or y axis ribs
edgesrf_4 = EdgeSurface(CurveA=bbx_3.Curves, CurveB=bbx_4.Curves)

# ----
# 20.0 The position of slot placements is determined by
# using the brep/brep intersect component with the ribs surfaces as inputs.
# Brep A is flattern and Brep B is grafted to ensure the correct number of components
bbx_5 = BrepBrep(BrepA=flatten(edgesrf_4), BrepB=graft(edgesrf_2))  # -> Curves, Points; disabled

# ----
# 21.0 The Perp Frame Component is used to create a perpendicular plane on
# each of the intersections of the ribs. In this instance 0.5 is the center point
# of each curve, thus a perpendicular plane is created in the midpoint of each curve.
number_slider_7 = Slider(0.5, range=0..1)  # disabled
pframe = PerpFrame(Curve=reparameterize(bbx_5.Curves), Parameter=number_slider_7)  # disabled

# ----
# 22.0 Square Curves are generated on each plane, which in step 23.0 are then extruded to form the notches. The square curves account for the thickness of the cardboard
number_slider_8 = Slider(2, range=0..10)  # disabled
division = Division(A=cardboard_thickness, B=number_slider_8)  # disabled
neg = Negative(Value=division)  # disabled
dom_2 = ConstructDomain(DomainStart=division, DomainEnd=neg)  # disabled
rectangle = Rectangle(Plane=pframe, XSize=dom_2, YSize=dom_2, Radius=0)  # -> Rectangle, Length; disabled

# ----
# C. The list is then grouped and flattened. This allows the data
#  to be utilised to select the 22 branches along the Y axis
group = Group(Objects=flip_2)  # -> flatten(Group)
viewer = ParamViewer(group)

panel_2 = Panel(divide_2.Points)

flip_3 = FlipMatrix(Data=divide_2.Points)

shift_2 = ShiftList(List=flip_3, Shift=Slider(2, range=0..10), Wrap=True)

flip_4 = FlipMatrix(Data=divide_2.Points)

# ----
# Allow for the rotation of the intital pattern across the whole x Axis
number_slider_9 = Slider(3, range=0..10)
shift_3 = ShiftList(List=flip_4, Shift=number_slider_9, Wrap=True)

flip_5 = FlipMatrix(Data=divide_2.Points)

# ----
# 1
# Allow for the rotation of the intital pattern across the whole x Axis
number_slider_10 = Slider(1, range=0..10)
shift_4 = ShiftList(List=flip_5, Shift=number_slider_10, Wrap=True)

# ----
# 23.0 The squared created in 21.0 were then extruded into 2 rectangles,
# one going up and the other going down (achieved through the negative value component)
number_slider_11 = Slider(45, range=0..100)  # disabled
neg_2 = Negative(Value=number_slider_11)  # disabled
boxrec = BoxRectangle(Rectangle=rectangle.Rectangle, Height=number_slider_11)  # disabled
boxrec_2 = BoxRectangle(Rectangle=rectangle.Rectangle, Height=neg_2)  # disabled

# ----
# B By flipping the matrix, the branches and indexes are reversed, hence allowing for the indexes to be selectable.
flip_6 = FlipMatrix(Data=shift_2)  # -> simplify(Data)
viewer_2 = ParamViewer(flip_6)

# ----
# B By flipping the matrix, the branches and indexes are reversed, hence allowing for the indexes to be selectable.
flip_7 = FlipMatrix(Data=shift_3)  # -> simplify(Data)
viewer_3 = ParamViewer(flip_7)

# ----
# B By flipping the matrix, the branches and indexes are reversed, hence allowing for the indexes to be selectable.
flip_8 = FlipMatrix(Data=shift_4)  # -> simplify(Data)
viewer_4 = ParamViewer(flip_8)

# ----
# C. The list is then grouped and flattened -
group_2 = Group(Objects=flip_6)  # -> flatten(Group)
viewer_5 = ParamViewer(group_2)

# ----
# C. The list is then grouped and flattened -
group_3 = Group(Objects=flip_7)  # -> flatten(Group)
viewer_6 = ParamViewer(group_3)

# ----
# C. The list is then grouped and flattened
group_4 = Group(Objects=flip_8)  # -> flatten(Group)
viewer_7 = ParamViewer(group_4)

# ----
# WHY IS THIS HERE?
number_slider_12 = Slider(2, range=0..10)
lng = ListLength(List=flip_8)
panel_3 = Panel(lng)
division_2 = Division(A=lng, B=number_slider_12)

trim = TrimSolid(Shape=flatten(edgesrf_4), Cutters=flatten(boxrec))  # disabled
# 24.0 The boxes created in 23.0 are used to trim the surfaces to
#  from the notches used in assembling the lasercut model
trim_2 = TrimSolid(Shape=flatten(edgesrf_2), Cutters=flatten(boxrec_2))  # disabled

# ----
# 25.0 The component is used to place a point in the center of each input surface.
#  This data is then inputed into a point list component which generates a text number
number_slider_13 = Slider(4, range=0..10)  # disabled
area = Area(Geometry=flatten(trim))  # -> Area, Centroid; disabled
points = PointList(Points=area.Centroid, Size=number_slider_13)  # disabled

# ----
# 25.0 The component is used to place a point in the center of each input surface.
#  This data is then inputed into a point list component which generates a text number
number_slider_14 = Slider(4, range=0..10)  # disabled
area_2 = Area(Geometry=flatten(trim_2))  # -> Area, Centroid; disabled
points_2 = PointList(Points=area_2.Centroid, Size=number_slider_14)  # disabled

# ----
# 26.0 This step uses the linear array component to set out the points to unroll the ribs.
lng_2 = ListLength(List=flatten(trim))  # disabled
number_slider_15 = Slider(450, range=0..1000)  # disabled
Y_4 = UnitY(Factor=number_slider_15)  # disabled
pt_3 = Point(Point(0, 0, 0))  # disabled
arrlinear_2 = LinearArray(Geometry=pt_3, Direction=Y_4, Count=lng_2)  # -> Geometry, Transform; disabled

# ----
# 26.0 This step uses the linear array component to set out the points to unroll the ribs.
lng_3 = ListLength(List=flatten(trim_2))  # disabled
number_slider_16 = Slider(179, range=0..1000)  # disabled
Y_5 = UnitY(Factor=number_slider_16)  # disabled
pt_4 = Point(Point(0, 0, 0))  # disabled
arrlinear_3 = LinearArray(Geometry=pt_4, Direction=Y_5, Count=lng_3)  # -> Geometry, Transform; disabled

# ----
# CREATION OF RIBS ON X AXIS
# 27.0 The Curve Geometry is moved on the X Axis
number_slider_17 = Slider(400, range=0..1000)  # disabled
X_3 = UnitX(Factor=number_slider_17)  # disabled
move_6 = Move(Geometry=arrlinear_2.Geometry, Motion=X_3)  # -> Geometry, Transform; disabled

# ----
# CREATION OF RIBS ON Y AXIS
# 27.0 The Curve Geometry is moved on the X Axis
number_slider_18 = Slider(733, range=0..1000)  # disabled
X_4 = UnitX(Factor=number_slider_18)  # disabled
move_7 = Move(Geometry=arrlinear_3.Geometry, Motion=X_4)  # -> Geometry, Transform; disabled

# ----
# 28.0 The Curves are reorientated to be flat, the is planar component
#  extracts the base plane of each rib and lays it flat.
planar = IsPlanar(Surface=trim, Interior=True)  # -> Planar, Plane; disabled
orient = Orient(Geometry=flatten(trim), Source=flatten(planar.Plane), Target=flatten(move_6.Geometry))  # -> Geometry, Transform; disabled

# ----
# 28.0 The Curves are reorientated to be flat, the is planar component
#  extracts the base plane of each rib and lays it flat.
planar_2 = IsPlanar(Surface=trim_2, Interior=True)  # -> Planar, Plane; disabled
orient_2 = Orient(Geometry=flatten(trim_2), Source=flatten(planar_2.Plane), Target=flatten(move_7.Geometry))  # -> Geometry, Transform; disabled

# ----
# 30.0 The Curves of the Surfaces are extracted to create the geometry required for lasercutting
edges = BrepEdges(Brep=orient.Geometry)  # -> Naked, Interior, NonManifold; disabled
join = JoinCurves(Curves=edges.Naked, Preserve=False)  # disabled
cls = Closed(Curve=join)  # -> Closed, Periodic; disabled

# ----
# 29.0 The Points are then listed to number each rib to assist in assembly
number_slider_19 = Slider(7, range=0..10)  # disabled
area_3 = Area(Geometry=orient.Geometry)  # -> Area, Centroid; disabled
points_3 = PointList(Points=area_3.Centroid, Size=number_slider_19)  # disabled

# ----
# 30.0 The Curves of the Surfaces are extracted to create the geometry required for lasercutting
edges_2 = BrepEdges(Brep=orient_2.Geometry)  # -> Naked, Interior, NonManifold; disabled
join_2 = JoinCurves(Curves=edges_2.Naked, Preserve=False)  # disabled
cls_2 = Closed(Curve=join_2)  # -> Closed, Periodic; disabled

# ----
# 29.0 The Points are then listed to number each rib to assist in assembly
number_slider_20 = Slider(6, range=0..10)  # disabled
area_4 = Area(Geometry=orient_2.Geometry)  # -> Area, Centroid; disabled
points_4 = PointList(Points=area_4.Centroid, Size=number_slider_20)  # disabled

split = TextSplit(Text=pattern_2, Separators=",")
item = ListItem(List=split, Index=Slider(1, range=0..10), Wrap=True)

# ----
# D. A pattern to be repeated is created. Pannel one features the point co-ordinates
# of the panel in the order in which the polyline should be joined.
# 
# The list item (upper) reflects the first coordinate of the pattern (i.e the branch). This is because the list item index is set to 0.
# 
# The list item (lower) refects the second coordinate of the patter (i.e the index). As the list item index is set to 1.
# 
# The points are grafted and ungrouped to respect the point position in the tree instead of the flatterned list.
number_slider_21 = Slider(0, range=0..100)
item_2 = ListItem(List=split, Index=number_slider_21, Wrap=True)
item_3 = ListItem(List=group, Index=item_2, Wrap=True)
ungroup = Ungroup(Group=graft(item_3))  # -> simplify(Objects)
item_4 = ListItem(List=ungroup, Index=item, Wrap=True)
pline = PolyLine(Vertices=flatten(item_4), Closed=False)

# ----
# First branch repetition
panel_4 = Panel(split)
panel_5 = Panel(item)
panel_6 = Panel(item_2)

step = Slider(1, range=0..10)
# A Series is created using the list item generated from the patter.
# This details the number of points of data as the branches and the number of ribs
# along the X Axis.
# 
# The Upper Series Representing the branches co-ordindates
# 
# And the Lower, for the index i.e 8)
# 
# These series creates the reference points in the pattern to then
# generate the points to draw the polyline
lng_4 = ListLength(List=group)
series = Series(Start=graft(item_2), Step=step, Count=flatten(lng_4))
series_2 = Series(Start=graft(item), Step=step, Count=flatten(lng_4))

viewer_8 = ParamViewer(ungroup)

panel_7 = Panel(item_4)

panel_8 = Panel(lng_4)
viewer_9 = ParamViewer(series)
flip_9 = FlipMatrix(Data=flip_2)
flip_10 = FlipMatrix(Data=flip_9)
group_5 = Group(Objects=flip_10)  # -> flatten(Group)
viewer_10 = ParamViewer(flip_10)
viewer_11 = ParamViewer(group_5)

# ----
# This list item species the branches of the points
item_5 = ListItem(List=group_5, Index=series, Wrap=True)

viewer_12 = ParamViewer(item_5)
# HOW DO I MAKE THE PATTERN REPEAT ITSELF
# - My Attempt
panel_9 = Panel(item_5)
viewer_13 = ParamViewer(item_5)
ungroup_2 = Ungroup(Group=graft(item_5))
panel_10 = Panel(ungroup_2)
item_6 = ListItem(List=ungroup_2, Index=graft(series_2), Wrap=True)
viewer_14 = ParamViewer(item_6)
panel_11 = Panel(item_6)
unflatten = UnflattenTree(Tree=item_6, Guide=series_2)  # -> simplify(Tree)
flip_11 = FlipMatrix(Data=unflatten)
viewer_15 = ParamViewer(flip_11)
pline_2 = PolyLine(Vertices=flip_11, Closed=False)
viewer_16 = ParamViewer(pline_2)

# ----
# 3
panel_12 = Panel(",")
split_2 = TextSplit(Text=panel, Separators=panel_12)
item_7 = ListItem(List=split_2, Index=Slider(1, range=0..10), Wrap=True)

item_8 = ListItem(List=split_2, Index=Slider(0, range=0..100), Wrap=True)
item_9 = ListItem(List=group_2, Index=item_8, Wrap=True)
ungroup_3 = Ungroup(Group=graft(item_9))  # -> simplify(Objects)
item_10 = ListItem(List=ungroup_3, Index=item_7, Wrap=True)
pline_3 = PolyLine(Vertices=flatten(item_10), Closed=False)

viewer_17 = ParamViewer(ungroup_3)

split_3 = TextSplit(Text=panel, Separators=",")
item_11 = ListItem(List=split_3, Index=Slider(1, range=0..10), Wrap=True)

# ----
# FIRST 3 PATTERN REPETITION MANUALLY
number_slider_22 = Slider(0, range=0..100)
item_12 = ListItem(List=split_3, Index=number_slider_22, Wrap=True)
item_13 = ListItem(List=group_3, Index=item_12, Wrap=True)
ungroup_4 = Ungroup(Group=graft(item_13))  # -> simplify(Objects)
item_14 = ListItem(List=ungroup_4, Index=item_11, Wrap=True)
pline_4 = PolyLine(Vertices=flatten(item_14), Closed=False)

viewer_18 = ParamViewer(ungroup_4)

# ----
# Allow for the rotation of the intital pattern across the whole x Axis
# 2
panel_13 = Panel(",")
split_4 = TextSplit(Text=panel, Separators=panel_13)
item_15 = ListItem(List=split_4, Index=Slider(1, range=0..10), Wrap=True)

item_16 = ListItem(List=split_4, Index=Slider(0, range=0..100), Wrap=True)
item_17 = ListItem(List=group_4, Index=item_16, Wrap=True)
ungroup_5 = Ungroup(Group=graft(item_17))  # -> simplify(Objects)
item_18 = ListItem(List=ungroup_5, Index=item_15, Wrap=True)
pline_5 = PolyLine(Vertices=flatten(item_18), Closed=False)

viewer_19 = ParamViewer(ungroup_5)

group_6 = Group(Objects=flip_2)  # -> flatten(Group)
lng_5 = ListLength(List=group_6)
subtraction = Subtraction(A=lng_5, B="4")
series_3 = Series(Start=0, Step=Slider(1, range=0..10), Count=subtraction)
int = Integer(flatten(item))
int_2 = Integer(flatten(item_2))
shift_5 = ShiftList(List=group_6, Shift=series_3, Wrap=True)
item_19 = ListItem(List=shift_5, Index=int_2, Wrap=True)
ungroup_6 = Ungroup(Group=item_19)
tstat = TreeStatistics(Tree=ungroup_6)  # -> Paths, Length, Count
repeat = RepeatData(Data=int, Length=tstat.Count)  # -> graft(Data)
item_20 = ListItem(List=ungroup_6, Index=repeat, Wrap=True)
pshift = ShiftPaths(Data=item_20, Offset=-1)
panel_14 = Panel("""True
False""")

# ---- group: This ? Or
pline_6 = PolyLine(Vertices=pshift, Closed=False)  # -> flatten(Polyline)

# ----
cull = CullPattern(List=pline_6, CullPattern=panel_14)

# ---- group: That
move_8 = Move(Geometry=[cull, group_6], Motion=Vector(-253, 0, 0))  # -> Geometry, Transform
