# Grasshopper definition e4851e550b5a1b6e48b14d5b1bbfb989f62a3a8a.ghx (Grasshopper 1.0.7)
# plug-ins: EleFront

crv = Curve([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])
seed = Slider(1, range=1..15)
boundary = BoundarySurfaces(Edges=crv)
dom = ConstructDomain(DomainStart="0", DomainEnd="2")
lng = ListLength(List=flatten(boundary))
random = Random(Range=dom, Number=lng, Seed=seed, Integers=True)
bnd = Bounds(Numbers=random)
dedomain = DeconstructDomain(Domain=bnd)  # -> Start, End
graft = GraftTree(Tree=[dedomain.End, dedomain.Start, random], IncludeEmptyLists=True, IncludeNullItems=True)
simplify = SimplifyTree(Tree=graft, Front=False)
gradient = Gradient(
    LowerLimit=dedomain.Start,
    UpperLimit=dedomain.End,
    Parameter=random,
    stops=[0.115: RGB(234, 38, 0), 0.509: RGB(71, 69, 66), 1: RGB(161, 161, 161)])
preview = CustomPreview(Geometry=flatten(boundary), Shader=gradient)
panel = Panel(simplify)
sift = SiftPattern(List=boundary, SiftPattern=random)  # -> Output0, Output1, Output2
subset = SubList(List=graft, Wrap=True)  # -> List, Index
sift_2 = SiftPattern(List=gradient, SiftPattern=random)  # -> Output0, Output1, Output2
entwine = Entwine(Branch00=sift_2.Output0, Branch01=sift_2.Output1, Branch02=sift_2.Output2, FlattenInputs=True)
entwine_2 = Entwine(Branch00=sift.Output0, Branch01=sift.Output1, Branch02=sift.Output2, FlattenInputs=True)
panel_2 = Panel("""Curves::First Layer
Curves::Second Layer
Curves::Third Layer""")
panel_3 = Panel("""Model::First Layer
Model::Second Layer
Model::Third Layer""")
clean = CleanParallel(PrimaryData=entwine_2, removeEmpty=True)  # -> simplify(PrimaryData), SecondaryData
clean_2 = CleanParallel(PrimaryData=entwine, removeEmpty=True)  # -> simplify(PrimaryData), SecondaryData1
graft_2 = GraftTree(Tree=panel_2, IncludeEmptyLists=True, IncludeNullItems=True)
graft_3 = GraftTree(Tree=panel_3, IncludeEmptyLists=True, IncludeNullItems=True)
panel_4 = Panel(graft)
graft_4 = GraftTree(Tree=clean.PrimaryData, IncludeEmptyLists=True, IncludeNullItems=True)
dup = DuplicateDataMatch(SourceDataTree=clean_2.PrimaryData, SecondaryData1=graft_2)  # -> SourceData, graft(SecondaryData1)
dup_2 = DuplicateDataMatch(SourceDataTree=clean_2.PrimaryData, SecondaryData=graft_3)  # -> SourceData, graft(SecondaryData)
graft_5 = GraftTree(Tree=clean_2.PrimaryData, IncludeEmptyLists=True, IncludeNullItems=True)
attributes = DefineObjectAttributes(Layer=dup.SecondaryData1, Color=graft_5)
attributes_2 = DefineObjectAttributes(Layer=dup_2.SecondaryData, Color=graft_5)
edges = BrepEdges(Brep=graft_4)  # -> Naked, Interior, NonManifold
join = JoinCurves(Curves=edges.Naked, Preserve=False)
button = Button()
bake = BakeObjects(Geometry=graft_4, Attributes=attributes_2, BakeName="Model", Bake=button)
bake_2 = BakeObjects(Geometry=join, Attributes=attributes, BakeName="Curves", Bake=button)
