# Grasshopper definition e9318fe68801f4660411b9bfb688a46cd5780b04.ghx (Grasshopper 1.0.7)
# plug-ins: Weaverbird, Kangaroo2 Components

number_slider = Slider(7, range=0..100)
Z = UnitZ(Factor=1)
crv = Curve(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)
line = LineSDL(Start=Point(0, 0, 0), Direction=Z, Length=1)
divide = DivideCurve(Curve=crv, Count=number_slider, Kinks=False)  # -> Points, Tangents, Parameters
revsrf = Revolution(Curve=crv, Axis=line, Domain=Domain(0, 6.283185307))
srf_cp = SurfaceClosestPoint(Point=divide.Points, Surface=reparameterize(revsrf))  # -> Point, UVPoint, Distance
iso = IsoCurve(Surface=reparameterize(revsrf), UVPoint=srf_cp.UVPoint)  # -> UIsocurve, VIsocurve
# Vase shape
crv_2 = Curve(iso.UIsocurve)
series = Series(Start=0, Step=1, Count=expr("x+1", number_slider))  # -> graft(Series)
divide_2 = DivideCurve(Curve=crv_2, Count=Slider(16, range=0..100), Kinks=False)  # -> Points, Tangents, Parameters
number_slider_2 = Slider(3, range=0..10)
shift = ShiftList(List=reverse(divide_2.Points), Shift=series, Wrap=True)
shift_2 = ShiftList(List=divide_2.Points, Shift=series, Wrap=True)
flip = FlipMatrix(Data=shift_2)
flip_2 = FlipMatrix(Data=shift)
intcrv = Interpolate(Vertices=flip, Degree=number_slider_2, Periodic=False, KnotStyle=1)  # -> Curve, Length, Domain
intcrv_2 = Interpolate(Vertices=flip_2, Degree=number_slider_2, Periodic=False, KnotStyle=1)  # -> Curve, Length, Domain
srfsplit = SurfaceSplit(Surface=revsrf, Curves=flatten([intcrv.Curve, intcrv_2.Curve]))
number_slider_3 = Slider(4, range=0..10)

smesh = SimpleMesh(Brep=srfsplit)

wbwindow = WeaverbirdsMeshWindow(MeshPolylines=smesh, Distance=number_slider_3, InsetType=0)  # -> flatten(OutMesh)
wbframe = WeaverbirdsPictureFrame(MeshPolylines=smesh, Distance=number_slider_3, InsetType=0)  # -> flatten(OutMesh)
clean = CombineClean(Meshes=graft(wbframe))  # -> flatten(Mesh)
area = Area(Geometry=wbwindow)  # -> Area, Centroid
medges = MeshEdges(Mesh=clean)  # -> NakedEdges, InteriorEdges, NonManifoldEdges
meshcp = MeshClosestPoint(Point=area.Centroid, Mesh=wbwindow)  # -> Point, Index, Parameter
join = JoinCurves(Curves=medges.NakedEdges, Preserve=False)
meval = MeshEval(Mesh=wbwindow, Parameter=meshcp.Parameter)  # -> Point, Normal, Colour
item = ListItem(List=join, Index="1", Wrap=True)
line_2 = LineSDL(Start=meval.Point, Direction=meval.Normal, Length=1)
smesh_2 = SimpleMesh(Brep=item)  # -> flatten(Mesh)
end = EndPoints(Curve=line_2)  # -> Start, End
Z_2 = UnitZ(Factor=1)
pl = ConstructPlane(Origin=end.Start, XAxis=end.End, YAxis=Z_2)
rotate = Rotate(Geometry=smesh_2, Angle=degrees(Slider(83, range=0..180)), Plane=pl)  # -> Geometry, Transform
faceb = FaceBoundaries(Mesh=rotate.Geometry)
explode = Explode(Curve=item, Recursive=True)  # -> Segments, Vertices
pshift = ShiftPaths(Data=explode.Segments, Offset=-1)
explode_2 = Explode(Curve=faceb, Recursive=True)  # -> Segments, Vertices
end_2 = EndPoints(Curve=pshift)  # -> graft(Start), graft(End)
end_3 = EndPoints(Curve=explode_2.Segments)  # -> graft(Start), graft(End)
merge = Merge(Data1=end_2.Start, Data2=end_2.End, Data3=end_3.End, Data4=end_3.Start)
flipm = FlipMesh(Mesh=rotate.Geometry, VertexNormals=True, FaceNormals=True, FaceOrientation=True)  # -> graft(Result)
conmesh = ConstructMesh(Vertices=reverse(merge), Faces={A=0, B=1, C=2, D=3})
pshift_2 = ShiftPaths(Data=conmesh, Offset="-2")
number_slider_4 = Slider(2, range=0..3)
merge_2 = Merge(Data1=pshift_2, Data2=flipm)
clean_2 = CombineClean(Meshes=merge_2)
wbcatmullclark = WeaverbirdsCatmullClarkSubdivision(MeshCurves=clean_2, Level=number_slider_4, SmoothNakedEdges="0")
wbsplitquads = WeaverbirdsConstantQuadsSplitSubdivision(MeshCurves=clean, Level=number_slider_4, SmoothNakedEdges="0")
flipm_2 = FlipMesh(Mesh=wbsplitquads, VertexNormals=True, FaceNormals=True, FaceOrientation=True)

clean_3 = CombineClean(Meshes=flatten([flipm_2, wbcatmullclark]))
panel = Panel(clean_3)
