# Grasshopper definition eb06fc22ea80379c83f339b9008deb8e3a731ce9.ghx (Grasshopper 1.0.7)

# ---- group: Flatenned list
pt = Point([Point(-39.16596222, -4.525155306, 0), Point(-37.07526398, -3.368496299, 0), Point(-34.69312477, -3.553688645, 0), Point(-32.71255112, -1.9788903, 0), Point(-30.19218445, -1.754374146, 0), Point(-27.69923592, -1.281960845, 0)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])

# ---- group: Tree Structure to Copy
pt_2 = Point(Tree({0;0}: [Point(4.912921912, -11.06320412, 0)], {0;1}: [Point(2.20063176, -11.57049025, 0), Point(6.952574368, -9.217083823, 0)], {0;2}: [Point(-0.7797721417, -12.0752454, 0), Point(4.566621976, -9.700855171, 0), Point(8.595999738, -7.430752884, 0)], {0;3}: [Point(-3.944541248, -12.45962842, 0), Point(1.857238985, -10.29194011, 0), Point(6.565048457, -7.79139601, 0), Point(9.84571655, -5.789612753, 0)], {0;4}: [Point(-7.190011987, -12.61703314, 0), Point(-1.113531038, -10.86704967, 0), Point(4.182228068, -8.367565845, 0), Point(8.159814482, -5.939853031, 0), Point(10.77051045, -4.349265259, 0)], {0;5}: [Point(-10.40329168, -12.47587045, 0), Point(-4.256847098, -11.29136661, 0), Point(1.482646031, -9.052902325, 0), Point(6.127973474, -6.388592645, 0), Point(9.362728907, -4.240967458, 0), Point(11.5355589, -3.117505243, 0)]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))

# ----
points = PointList(Points=pt_2, Size=Slider(1.6, range=0..10))
pt2num = PointsToNumbers(Points=graft(pt_2), Mask=4)
pt2num_2 = PointsToNumbers(Points=graft(pt), Mask=4)
ma = MassAddition(Input=pt2num_2)  # -> Result, PartialResults
ma_2 = MassAddition(Input=pt2num)  # -> Result, PartialResults
unflatten = UnflattenTree(Tree=ma_2.Result, Guide=pt_2)
expression = Expression(x=ma.Result, Expression="Round(x,3)")  # -> flatten(R)
expression_2 = Expression(x=unflatten, Expression="Round(x,3)")
mindex = MemberIndex(Set=expression, Member=expression_2)  # -> Index, Count
pshift = ShiftPaths(Data=mindex.Index, Offset=-1)
item = ListItem(List=pt, Index=pshift, Wrap=True)
points_2 = PointList(Points=item, Size=Slider(1.02, range=0..10))
viewer = ParamViewer(pt_2)
pline = PolyLine(Vertices=item, Closed=False)
viewer_2 = ParamViewer(item)
