# Grasshopper definition ebbe2ca3a4a55d40076dee48414d239872168c0d.ghx (Grasshopper 1.0.7)
# plug-ins: TbGh18, Bifocals, GhVa20

space = Space([<space referenced from the Rhino model> x8])
list_length = ListLength(List=space)
property_name = PropertyName({"name", "description", "tag", "volume", "area", "length", "width", "height", "elevation", "alignment", "alignmentOffset", "profileRoll", "rotation", "openingSide", "verticalAlignment", "maxAperture", "aperture", "stepCount", "tread", "riser", "thickness", "type", "edgeType", "GeneralSlope", "topHeight", "style"}, selected="name")
series = Series(Start="1", Step="1", Count=list_length)
text = Text(series)
update_property = UpdateProperty(ObjectID=graft(space), Property=graft(property_name), Value=graft(text))
