# Grasshopper definition ec3f7a283fcddfbd572d3619ca15f5f27e0e89a3.ghx (Grasshopper 1.0.7)

dom = ConstructDomain(DomainStart=Slider(0, range=0..10), DomainEnd=Slider(10, range=0..10))
range = Range(Domain=dom, Steps=Slider(5, range=0..10))
pt = ConstructPoint(XCoordinate=range, YCoordinate=range, ZCoordinate=range)
python = GhPythonScript(x=pt)  # -> point1, point2; inputs x: list of Point3d
# ---------- python: Python ----------
point1 = x[0]
point2 = x[5]
# ---------- end python ----------
