# Grasshopper definition f0715c8a0791e461eca27971dd2a199af6fc2341.ghx (Grasshopper 1.0.7)
# plug-ins: PTComponentLibrary

crv = Curve(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)
number_slider = Slider(25, range=0..100)
neg = Negative(Value=number_slider)
dom = ConstructDomain(DomainStart=neg, DomainEnd=number_slider)
neg_2 = Negative(Value=Slider(50, range=0..100))

# ---- group: 2nd problem
random = Random(Range=Slider(0.5, range=0..1), Number=1, Seed=2)
dom_2 = ConstructDomain(DomainStart=random, DomainEnd="1")
subcrv = SubCurve(BaseCurve=reparameterize(crv), Domain=dom_2)

# ----
ptdividedis = DivideDistance(Curve=subcrv, Distance=Slider(150, range=0..1000), AddEnd=Toggle(False))

# ---- group: 2nd problem (continued)
crv_cp = CurveClosestPoint(Point=ptdividedis, Curve=reparameterize(crv))  # -> Point, Parameter, Distance

# ---- group: 1st problem
hframe = HorizontalFrame(Curve=reparameterize(crv), Parameter=crv_cp.Parameter)

# ----
box = DomainBox(Base=hframe, X=dom, Y=neg_2, Z=Slider(1000, range=0..100000))
