# Grasshopper definition f6d667e69b3ace07a4545e59e4a9be81ab5b305f.ghx (Grasshopper 1.0.7)

srf = Surface(reparameterize(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))
sdivide = DivideSurface(Surface=srf, UCount=Slider(10, range=1..50), VCount=Slider(28, range=1..100))  # -> Points, Normals, Parameters
image = ImageSampler(sdivide.Parameters, Filter="Value", Interpolate=False, Umax=1, Umin=0, Vmax=1, Vmin=0, Wrap=1)
rev = Reverse(Vector=sdivide.Normals)
eval = Evaluate(F="x+0.60", x=image)
line = LineSDL(Start=sdivide.Points, Direction=sdivide.Normals, Length=Slider(0.17, range=0..10))
end = EndPoints(Curve=line)  # -> Start, End
surface_to_extrude_up_to = Surface(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)
project = ProjectPoint(Point=sdivide.Points, Direction=rev, Geometry=surface_to_extrude_up_to)  # -> Point, Index
ln = Line(StartPoint=end.End, EndPoint=project.Point)
pipe = Pipe(Curve=ln, Radius=expr("x/80", eval), Caps=2)
