# Grasshopper definition f90b321be43d580dec306ee89042268f9fbc40d3.ghx (Grasshopper 1.0.7)
# Copyright: zooid design
# plug-ins: Shader Nodes

emission = EmissionBSDF(Color=ColourSwatch(SwatchColor=RGB(255, 114, 255)), Strength=Slider(785.882, range=0..1100))
glossy = GlossyBSDF(Color=ColourSwatch(SwatchColor=RGB(255, 255, 255)), Roughness=Slider(0, range=0..100), Distribution="Sharp")
glass = GlassBSDF(
    Color=ColourSwatch(SwatchColor=RGB(0, 131, 255)),
    Roughness=Slider(0.267, range=0..1),
    IOR=Slider(1.3, range=0..3),
    Distribution="GGX")
output = Output(Surface=glossy)
output_2 = Output(Surface=glass)
output_3 = Output(Surface=emission)
brep = Brep(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)
cyl = Cylinder(Base=PlaneXY(0, 0, 0), Radius=0.5, Length=1)
brep_2 = Brep(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)
cap = CapHoles(Brep=cyl)
preview = CustomPreview(
    Geometry=brep,
    Material={diffuse=RGB(255, 105, 180), emission=RGB(0, 0, 0), shine=0, specular=RGB(255, 255, 255), transparency=0})
preview_2 = CustomPreview(
    Geometry=cap,
    Material={diffuse=RGB(255, 105, 180), emission=RGB(0, 0, 0), shine=0, specular=RGB(255, 255, 255), transparency=0})
preview_3 = CustomPreview(
    Geometry=brep_2,
    Material={diffuse=RGB(255, 105, 180), emission=RGB(0, 0, 0), shine=0, specular=RGB(255, 255, 255), transparency=0})
